# Dynamo graph RFNRY-ADSK-SA-XX-GR-Z-0001 Bnh.dyn "01-Bnh" (Dynamo 2.0.2.6826)

# note: Checking / Outputs
# Orange indicates checking nodes to ensure the script has deployed correctly.

# group: BNH Refinery Graph Example
# note: DYNAMO PROJECT
# 01-BNH.dyn
# note: ASSOCIATED FILE(S)
# N/A
# note: AUTHOR(S) / CREATION DATE
# Refinery Team / Dec 2018
# note: DESCRIPTION
# The BNH graph refers to the Binh and Korn function that seeks to optimize the results of a multi-objective algorithm. This function is usually used for testing optimization engines (at this time we do not implment constraints for this function). In this case we want to minimize our numeric outputs.
# This graph is used to showcase how Refinery works with a Pareto curve outputs when two conflicting objectives exist in the problem.
# note: DYNAMO VERSION
# 2.0.2
# note: ADDITIONAL COMMENTS
# N/A
# note: REQUIRED DYNAMO PACKAGES
# N/A

# group: Input: Changeable variables
# note: Variables / Inputs
# Red indicates Variables that can be altered per project and must be set accordingly before running the script.
# note: NOTE:
# In order to see an 'Input' in Refinery, you have to right-click on a compatible node and check the 'Is Input' option. Rename the node to see a legible input name in Refinery.
input_1 = DoubleSlider(1, range=0..5 step 0.01)  # graph input
# note: Working / Functions
# Green indicates the working of the script. No changes should be made in these groups unless advised.
input_2 = DoubleSlider(2, range=0..3 step 0.01)  # graph input

# group: Data: Calculations
code_block = CodeBlock(x=input_1, y=input_2) { (4 * x * x) + (4 * y * y); ((x - 5) * (x - 5)) + ((y - 5) * (y - 5)); }

# group: Output Output information that can be used to filter results in Refinery
# note: NOTE:
# In order to see an 'Output' in Refinery, you have to right-click on a compatible node and check the 'Is
# Output' option. Rename the node to see a legible output name in Refinery.
output_01 = Watch(code_block.out0)  # graph output
# note: NOTE:
# In order to see the Pareto Front in the Scatter Plot, select Output-01 and Output-02 for X and Y Axis
output_02 = Watch(code_block.out1)  # graph output
