# Dynamo graph RFNRY-ADSK-SA-XX-GR-Z-0003 DiamondPanels.dyn "03-DiamondPanels" (Dynamo 2.0.3.8810)

# note: Variables / Inputs
# Red indicates Variables that can be altered per project and must be set accordingly before running the script.
# note: Checking / Outputs
# Orange indicates checking nodes to ensure the script has deployed correctly.
# note: Working / Functions
# Green indicates the working of the script. No changes should be made in these groups unless advised.

# group: DIAMOND PANELS Refinery Graph Example
# note: DYNAMO PROJECT
# REFINERY_DIAMOND_PANELS
# note: ASSOCIATED FILE(S)
# RAC_Basic_sample_project.rvt
# note: AUTHOR(S) / CREATION DATE
# Refinery Team / Dec 2018
# note: DESCRIPTION
# This graph will take a given surface and apply a 'Diamond' panel across it based on chosen values for the 'U' and 'V' inputs. It will output a series of metrics to run Refinery against and the user to choose the most optimal result.
# note: DYNAMO VERSION
# 2.0.2
# note: ADDITIONAL COMMENTS
# This graph has to be ran in Revit: Revit Nodes are only accessible in Dynamo for Revit and not through Dynamo Sandbox.
# If you open the graph in Dynamo Sandbox, Data Remember node will use the data that was serialized from previous runs of the graph.
# note: REQUIRED DYNAMO PACKAGES
# Lunchbox for Dynamo - v2018.7.6
# Note:
# The Lunchbox installation instructions are now the txt file in the Extra folder. To install Lunchbox you have to use an external installer in liue of the Package Manager.

# group: Surface [Dynamo]: Testing surface to run pannelation on prior to bringing into Revit
number = DoubleInput(9000)
number_2 = DoubleInput(6500)
# note: Generating a simple Rectangle by inputting a Width and Length number.
byWidthLength = Rectangle.ByWidthLength(width=number, length=number_2)
# note: Creating a Surface from a closed loop of curves.
# note: To test on the Dynamo Surface - run the Wire output from the Surface.ByPatch node into the Code Block input of 'thesurface' instead of the Data.Remember node's content.
byPatch = Surface.ByPatch(closedCurve=byWidthLength)

# group: Surface [Revit]: Get roof from Revit, select top face and remember it
# note: Select a 'Face' inside of Revit to apply Diamond Grid Panel to.
# Note: This example uses one face of the 'Extrusion Roof' in the Revit Basic Sample Project.
select_face = DSFaceSelection()  # 1 picked in the model
# note: The output of the 'Select Face' node is a list typically, so we use the List.Flatten node to remove the list structure from singular objects.
flatten = List.Flatten(list=select_face)
# note: Refinery Node that allows Data to be remembered if nothing else is fed into the in port.
# Note: This example remembers one of the Roof Surfaces from the Revit Basic Sample Project.
remember = Data.Remember(flatten)

# group: Passing Through
# note: A Code Block with a single variable that simply passes through the information that is fed into the auto-generated input port. This can be used to clean up wires or for graph clarity.
surface = CodeBlock(thesurface=remember) { thesurface; }

# group: Inputs: Changeable variables
# note: Number of Panels in the 'U' direction.
number_of_u_panels = IntegerSlider(17, range=1..30 step 1)  # graph input
# note: Number of Panels in the 'V' direction.
# note: NOTE:
# In order to see an 'Input' in Refinery, you have to right-click on a compatible node and check the 'Is Input' option. Rename the node to see a legible input name in Refinery.
number_of_v_panels = IntegerSlider(25, range=1..30 step 1)  # graph input

# group: Surface Divisions: Divides the selected surface in the U and V directions
# note: This node will return the total Surface Area of our chosen Surface.
area = Surface.Area(surface=surface)
# note: Custom Package: LunchBox
# This node takes our chosen Surface and will output Quad and Trianglular points and panels.
panelDiamond = Geometry.Panel.PanelDiamond(srf=surface, u=number_of_u_panels, v=number_of_v_panels)
# note: From the Surface Quad Panels we get the Surface Area for each quad as a Double (Number).
area_2 = Surface.Area(surface=panelDiamond.QuadPanels)
# note: This node will sum up all the Surface Area values from our Quad Panels.
sum = Math.Sum(values=area_2)
# note: We use the minus node to take away the summed Surface Area from our Quad panels from the total Surface Area from our chosen Roof Surface, which gives us the Total Area of Cut-Off Panels.
sub = area - sum

# group: Outputs: Output information that can be used to filter results in Refinery
# note: Surface.Area is unitless inside of Dynamo and will base itself on your Revit Project's unit settings. Use this node to convert to a more legible format.
convert_between_units = DynamoConvert(sub, MeasurementType="Area", FromConversion="SquareMillimeter", ToConversion="SquareMeter")
code_block = CodeBlock { 2; }
# note: Rounding the resultant area to 2 decimal places.
round = Math.Round(number=convert_between_units, digits=code_block)
# note: Counting the Full Panels.
count = List.Count(list=panelDiamond.QuadPanels)
number_of_panels = Watch(count)  # graph output
# note: Surface Area of all panels is divided by the toal panel count to give us an area of each individual panel.
div = sum / count
convert_between_units_2 = DynamoConvert(div, MeasurementType="Area", FromConversion="SquareMillimeter", ToConversion="SquareMeter")
round_2 = Math.Round(number=convert_between_units_2, digits=code_block)

code_block_2 = CodeBlock(tap=round) { tap[0]; }

# group (continued): Outputs: Output information that can be used to filter results in Refinery
total_area_of_cut_off_panels = Watch(code_block_2)  # graph output

# group: Visualization: Colourizes Dynamo geometry in the Background Preview window
# note: Create quadrilatral polygons from a list of points.
byPoints = Polygon.ByPoints(points=panelDiamond.QuadPoints)
# note: Create Surfaces from quadrilateral polygons. Hide preview to stop graphical flickering when colourizing.
byPatch_2 = Surface.ByPatch(closedCurve=byPoints)
color_palette = ColorPalette({R: 5, G: 195, B: 222, A: 255})
# note: Colourize quadrilateral polygons in the Dynamo Background Preview.
byGeometryColor = Modifiers.GeometryColor.ByGeometryColor(geometry=byPatch_2, color=color_palette)
# note: Create triangulated polygons from a list of points.
byPoints_2 = Polygon.ByPoints(points=panelDiamond.TriPoints)
byPatch_3 = Surface.ByPatch(closedCurve=byPoints_2)
color_palette_2 = ColorPalette({R: 255, G: 138, B: 61, A: 255})
# note: Colourize triangulated polygons in the Dynamo Background Preview.
byGeometryColor_2 = Modifiers.GeometryColor.ByGeometryColor(geometry=byPatch_3, color=color_palette_2)

code_block_3 = CodeBlock(fpa=round_2) { fpa[0]; }

# group (continued): Outputs: Output information that can be used to filter results in Refinery
# note: NOTE:
# In order to see an 'Output' in Refinery, you have to right-click on a compatible node and check the 'Is
# Output' option. Rename the node to see a legible output name in Refinery.
full_panel_area = Watch(code_block_3)  # graph output
