# Dynamo graph RFNRY-ADSK-SA-XX-GR-Z-0004 MaterialCosts.dyn "04-MaterialCosts" (Dynamo 2.0.2.6826)

# note: Working / Functions
# Green indicates the working of the script. No changes should be made in these groups unless advised.

# group: MATERIAL COSTS Refinery Graph Example
# note: DYNAMO PROJECT
# REFINERY_MATERIAL_COSTS
# note: ASSOCIATED FILE(S)
# N/A
# note: AUTHOR(S) / CREATION DATE
# Refinery Team and The Proving Ground / Dec 2018
# note: DESCRIPTION
# A building with a fixed volume is being built with different materials, and each material cost per square foot is different. In this example, the material for the sides of the building cost $6/sqft while the material for the top and bottom cost $10/sqft. If the length of the building is three times the width, what dimensions are needed to minimize the material cost for the entire building?
# note: DYNAMO VERSION
# 2.0.2
# note: ADDITIONAL COMMENTS
# N/A
# note: REQUIRED DYNAMO PACKAGES
# N/A

# group: Input: Changeable variables
# note: Variables / Inputs
# Red indicates Variables that can be altered per project and must be set accordingly before running the script.
# note: NOTE:
# In order to see an 'Input' in Refinery, you have to right-click on a compatible node and check the 'Is Input' option. Rename the node to see a legible input name in Refinery.
surface_dimensions = DoubleSlider(100, range=20..100 step 1)  # graph input

# group: User Settings: Fixed variables
# note: Checking / Outputs
# Orange indicates checking nodes to ensure the script has deployed correctly.
cost_of_sides = CodeBlock { 6; }
cost_of_top_and_bottom = CodeBlock { 10; }
building_volume_area = DoubleInput(300000)

# group: Geometry [Dynamo]: Building a rectangular solid
w_2 = surface_dimensions * surface_dimensions
# note: Generating geometry
code_block = CodeBlock { 3; }
mul = w_2 * code_block
div = building_volume_area / mul
mul_2 = surface_dimensions * code_block
byWidthLength = Rectangle.ByWidthLength(width=surface_dimensions, length=mul_2)
extrudeAsSolid = Curve.ExtrudeAsSolid(curve=byWidthLength, distance=div)
# note: DesignScript code to get all sub-surfaces from the Solid and split them into 'Walls' and 'Floors/Ceilings' based around a Point's Z-value from the center of each surface.
code_block_2 = CodeBlock(g=extrudeAsSolid)
# ---------- code_block_2.designscript (5 lines) ----------
subSurfaces = g.Explode();
subZ = subSurfaces.PointAtParameter(0.5,0.5).Z;
mask = subZ == List.MaximumItem(subZ) || subZ == List.MinimumItem(subZ);
ceilingRoof = List.FilterByBoolMask(subSurfaces, mask)["in"];
walls = List.FilterByBoolMask(subSurfaces, mask)["out"];
# ----------------------------------------

# group: Cost Evaluation
mul_3 = cost_of_sides * cost_of_top_and_bottom
mul_4 = w_2 * mul_3
number = DoubleInput(48)
mul_5 = surface_dimensions * number
mul_6 = div * mul_5

# group: Output: Output information that can be used to filter results in Refinery
# note: NOTE:
# In order to see an 'Output' in Refinery, you have to right-click on a compatible node and check the 'Is
# Output' option. Rename the node to see a legible output name in Refinery.
material_cost = mul_4 + mul_6  # graph output

# group: Visualization: Colourizes Dynamo geometry in the Background Preview window
color_palette = ColorPalette({R: 5, G: 195, B: 222, A: 255})
byGeometryColor = Modifiers.GeometryColor.ByGeometryColor(geometry=code_block_2.ceilingRoof, color=color_palette)
color_palette_2 = ColorPalette({R: 255, G: 138, B: 61, A: 255})
byGeometryColor_2 = Modifiers.GeometryColor.ByGeometryColor(geometry=code_block_2.walls, color=color_palette_2)
