# Dynamo graph RFNRY-ADSK-SA-XX-GR-Z-0005 FindMidpoint1D.dyn "05-FindMidpoint1D" (Dynamo 2.0.2.6826)

# note: Checking / Outputs
# Orange indicates checking nodes to ensure the script has deployed correctly.

# group: FIND MIDPOINT: 1D Refinery Graph Example
# note: DYNAMO PROJECT
# 05-FindMidpoint1D.dyn
# note: ASSOCIATED FILE(S)
# N/A
# note: AUTHOR(S) / CREATION DATE
# Refinery Team and The Proving Ground / Dec 2018
# note: DYNAMO VERSION
# 2.0.2
# note: ADDITIONAL COMMENTS
# N/A
# note: REQUIRED DYNAMO PACKAGES
# N/A
# note: DESCRIPTION
# This graph will find the distance between two fixed points (Start and End) in relation to a changeable point in the X-dimension only. It will get the absolute values (No positive/negative association) and query their distance relationships. If the queried value is "Zero" then the input has found the Midpoint. Refinery is used to optimize this process and find the midpoint computationally.

# group: Input: Changeable variables
# note: Variables / Inputs
# Red indicates Variables that can be altered per project and must be set accordingly before running the script.
# note: Working / Functions
# Green indicates the working of the script. No changes should be made in these groups unless advised.
# note: NOTE:
# In order to see an 'Input' in Refinery, you have to right-click on a compatible node and check the 'Is Input' option. Rename the node to see a legible input name in Refinery.
midpoint_x_location = IntegerSlider(13, range=1..49 step 1)  # graph input

# group: Math: Find Midpoint Simple Problem in 1-Dimension
code_block = CodeBlock { 50; }
byCoordinates = Point.ByCoordinates(x=code_block)
byCoordinates_2 = Point.ByCoordinates()
byCoordinates_3 = Point.ByCoordinates(x=midpoint_x_location)
distanceTo = Geometry.DistanceTo(geometry=byCoordinates, other=byCoordinates_3)
distanceTo_2 = Geometry.DistanceTo(geometry=byCoordinates_2, other=byCoordinates_3)
sub = distanceTo - distanceTo_2
abs = Math.Abs(number=sub)

# group: Visualization: Colourizes Dynamo geometry in the Background Preview window
list_create = List.Create(item0=byCoordinates, item1=byCoordinates_2)
color_palette = ColorPalette({R: 5, G: 195, B: 222, A: 255})
byGeometryColor = Modifiers.GeometryColor.ByGeometryColor(geometry=list_create, color=color_palette)
color_palette_2 = ColorPalette({R: 255, G: 138, B: 61, A: 255})
byGeometryColor_2 = Modifiers.GeometryColor.ByGeometryColor(geometry=byCoordinates_3, color=color_palette_2)

# group: Outputs: Output information that can be used to filter results in Refinery
# note: NOTE:
# In order to see an 'Output' in Refinery, you have to right-click on a compatible node and check the 'Is
# Output' option. Rename the node to see a legible output name in Refinery.
difference_between_distances = Watch(abs)  # graph output
