# Dynamo graph RFNRY-ADSK-SA-XX-GR-Z-0006 FindMidpoint2D.dyn "06-FindMidpoint2D" (Dynamo 2.0.2.6826)

# note: Checking / Outputs
# Orange indicates checking nodes to ensure the script has deployed correctly.

# group: FIND MIDPOINT: 2D Refinery Graph Example
# note: DYNAMO PROJECT
# REFINERY_FIND_MIDPOINT_2D
# note: ASSOCIATED FILE(S)
# N/A
# note: AUTHOR(S) / CREATION DATE
# Refinery Team and The Proving Ground / Dec 2018
# note: DESCRIPTION
# This graph will find the distance between two fixed points (Start and End) in 2-dimensional space in relation to a changeable point in the X and Y dimensions. It will get the absolute values (No positive/negative association) and query their distance relationships. If the queried value is "Zero" then the input has found the Midpoint. Refinery is used to optimize this process and find the midpoint computationally.
# note: DYNAMO VERSION
# 2.0.2
# note: ADDITIONAL COMMENTS
# N/A
# note: REQUIRED DYNAMO PACKAGES
# N/A

# group: Input: Changeable variables
# note: Variables / Inputs
# Red indicates Variables that can be altered per project and must be set accordingly before running the script.
midpoint_x = IntegerSlider(26, range=1..49 step 1)  # graph input
# note: Working / Functions
# Green indicates the working of the script. No changes should be made in these groups unless advised.
# note: NOTE:
# In order to see an 'Input' in Refinery, you have to right-click on a compatible node and check the 'Is Input' option. Rename the node to see a legible input name in Refinery.
midpoint_y = IntegerSlider(24, range=1..49 step 1)  # graph input

# group: Math: Find Midpoint Simple Problem in 2-Dimensions
code_block = CodeBlock { 50; }
byCoordinates = Point.ByCoordinates(x=code_block, y=code_block)
byCoordinates_2 = Point.ByCoordinates(x=midpoint_x, y=midpoint_y)
distanceTo = Geometry.DistanceTo(geometry=byCoordinates, other=byCoordinates_2)
byCoordinates_3 = Point.ByCoordinates()
distanceTo_2 = Geometry.DistanceTo(geometry=byCoordinates_3, other=byCoordinates_2)

# group: DesignScript: Absolute values
code_block_2 = CodeBlock(d1=distanceTo, d2=distanceTo_2) { Math.Abs(d1-d2); d1+d2; }

# group: Output: Output information that can be used to filter results in Refinery
# note: NOTE:
# In order to see an 'Output' in Refinery, you have to right-click on a compatible node and check the 'Is
# Output' option. Rename the node to see a legible output name in Refinery.
difference = Watch(code_block_2.out0)  # graph output
total_distance = Watch(code_block_2.out1)  # graph output

# group: Visualization: Colourizes Dynamo geometry in the Background Preview window
list_create = List.Create(item0=byCoordinates, item1=byCoordinates_3)
color_palette = ColorPalette({R: 5, G: 195, B: 222, A: 255})
byGeometryColor = Modifiers.GeometryColor.ByGeometryColor(geometry=list_create, color=color_palette)
color_palette_2 = ColorPalette({R: 255, G: 138, B: 61, A: 255})
byGeometryColor_2 = Modifiers.GeometryColor.ByGeometryColor(geometry=byCoordinates_2, color=color_palette_2)
