# Dynamo graph RFNRY-ADSK-SA-XX-GR-Z-0007 PointDistanceArea.dyn "07-PointDistanceArea" (Dynamo 2.0.2.6826)

# group: POINT DISTANCE + AREA Refinery Graph Example
# note: DYNAMO PROJECT
# REFINERY_POINT_DISTANCE_AREA
# note: ASSOCIATED FILE(S)
# N/A
# note: AUTHOR(S) / CREATION DATE
# Refinery Team and The Proving Ground / Dec 2018
# note: DESCRIPTION
# This graph will take three point inputs dictated by their X and Y values and generate a Triangle. Each point is a certain distance from the center of the shape, and distance to center must be minimized while the area of the shape is maximized.
# note: DYNAMO VERSION
# 2.0.2
# note: ADDITIONAL COMMENTS
# N/A
# note: REQUIRED DYNAMO PACKAGES
# N/A

# group: Inputs: Changeable variables
# note: Variables / Inputs
# Red indicates Variables that can be altered per project and must be set accordingly before running the script.
# note: NOTE:
# In order to see an 'Input' in Refinery, you have to right-click on a compatible node and check the 'Is Input' option. Rename the node to see a legible input name in Refinery.
X1 = DoubleSlider(64.63869949, range=0..100 step 1)  # graph input
X2 = DoubleSlider(44.35087968, range=0..100 step 1)  # graph input
# note: Working / Functions
# Green indicates the working of the script. No changes should be made in these groups unless advised.
Y1 = DoubleSlider(41.38728565, range=0..100 step 1)  # graph input
X3 = DoubleSlider(80.57365415, range=0..100 step 1)  # graph input
# note: Checking / Outputs
# Orange indicates checking nodes to ensure the script has deployed correctly.
Y2 = DoubleSlider(10.82558634, range=0..100 step 1)  # graph input
Y3 = DoubleSlider(21.82444528, range=0..100 step 1)  # graph input

# group: Points: Create triangular points (Exterior triangle and centre point)
byCoordinates = Point.ByCoordinates(x=X1, y=X2)
byCoordinates_2 = Point.ByCoordinates(x=Y1, y=X3)
byCoordinates_3 = Point.ByCoordinates(x=Y2, y=Y3)
list_create = List.Create(item0=byCoordinates, item1=byCoordinates_2, item2=byCoordinates_3)
byPoints = PolyCurve.ByPoints(points=list_create, connectLastToFirst=list_create)
list_create_2 = List.Create(item0=Y1, item1=Y2, item2=X1)
average = Math.Average(numbers=list_create_2)
list_create_3 = List.Create(item0=X2, item1=X3, item2=Y3)
average_2 = Math.Average(numbers=list_create_3)
byCoordinates_4 = Point.ByCoordinates(x=average, y=average_2)

# group: Math: Calculate surface area of triangle
byPatch = Surface.ByPatch(closedCurve=byPoints)
area = Surface.Area(surface=byPatch)
sum = Math.Sum(values=area)
convert_between_units = DynamoConvert(sum, MeasurementType="Area", FromConversion="SquareMillimeter", ToConversion="SquareMeter")

# group: Query: Line lengths
list_create_4 = List.Create(item0=byCoordinates_3, item1=byCoordinates_4)
byPoints_2 = PolyCurve.ByPoints(points=list_create_4)
length = Curve.Length(curve=byPoints_2)
list_create_5 = List.Create(item0=byCoordinates_2, item1=byCoordinates_4)
byPoints_3 = PolyCurve.ByPoints(points=list_create_5)
length_2 = Curve.Length(curve=byPoints_3)
list_create_6 = List.Create(item0=byCoordinates, item1=byCoordinates_4)
byPoints_4 = PolyCurve.ByPoints(points=list_create_6)
length_3 = Curve.Length(curve=byPoints_4)

# group: Outputs: Output information that can be used to filter results in Refinery
total_area = Watch(convert_between_units)  # graph output
# note: NOTE:
# In order to see an 'Output' in Refinery, you have to right-click on a compatible node and check the 'Is
# Output' option. Rename the node to see a legible output name in Refinery.
curve_1_length = Watch(length)  # graph output
curve_2_length = Watch(length_2)  # graph output
curve_3_length = Watch(length_3)  # graph output

# group: Visualization: Colourizes Dynamo geometry in the Background Preview window
color_palette = ColorPalette({R: 5, G: 195, B: 222, A: 255})
byGeometryColor = Modifiers.GeometryColor.ByGeometryColor(geometry=byPoints, color=color_palette)
list_create_7 = List.Create(item0=byPoints_2, item1=byPoints_3, item2=byPoints_4)
color_palette_2 = ColorPalette({R: 255, G: 138, B: 61, A: 255})
byGeometryColor_2 = Modifiers.GeometryColor.ByGeometryColor(geometry=list_create_7, color=color_palette_2)
