# Dynamo graph RFNRY-ADSK-SA-XX-GR-Z-0010 WindowsFloorArea.dyn "10-WindowsFloorArea" (Dynamo 2.0.2.6826)

# note: Checking / Outputs
# Orange indicates checking nodes to ensure the script has deployed correctly.

# group: WINDOW VS. FLOOR AREA Refinery Graph Example
# note: DYNAMO PROJECT
# REFINERY_WINDOW_FLOOR_AREA
# note: ASSOCIATED FILE(S)
# N/A
# note: AUTHOR(S) / CREATION DATE
# Refinery Team and The Proving Ground / Dec 2018
# note: DESCRIPTION
# This example is based on natural ventilation codes that say that in order for a room to be naturally ventilated, window spacing must be 2xCeiling Height for windows on opposite sides of a room. For every 1 window the floor length increases by 2xHeight due to window spacing code. 2 windows are added for every additional ceiling height of 1' (after 9') which increases the floor ratio (width=1/2Length). Minimize floor area and maximize number of windows.
# This could be used for those who want to optimize natural ventilation, as it is based on natural ventilation code. More windows may be necessary to add as ceiling height increases as it creates a larger volume to ventilate, but minimization of floor area may help reduce energy costs and create less space to ventilate.
# note: DYNAMO VERSION
# 2.0.2
# note: ADDITIONAL COMMENTS
# N/A
# note: REQUIRED DYNAMO PACKAGES
# Lunchbox for Dynamo - v2018.7.6
# Note:
# The Lunchbox installation instructions are now the txt file in the Extra folder. To install Lunchbox you have to use an external installer in lieu of the Package Manager.

# group: Input: Changeable variables
# note: NOTE:
# In order to see an 'Input' in Refinery, you have to right-click on a compatible node and check the 'Is Input' option. Rename the node to see a legible input name in Refinery.
# note: Working / Functions
# Green indicates the working of the script. No changes should be made in these groups unless advised.
# note: Variables / Inputs
# Red indicates Variables that can be altered per project and must be set accordingly before running the script.
ceiling_height = DoubleSlider(21, range=9..25 step 1)  # graph input

# group: Room
number = DoubleInput(2)
mul = ceiling_height * number
number_2 = DoubleInput(13)
sub = mul - number_2
number_3 = DoubleInput(2)
mul_2 = ceiling_height * number_3
mul_3 = mul_2 * sub
number_4 = DoubleInput(2)
div = mul_3 / number_4
byWidthLength = Rectangle.ByWidthLength(width=div, length=mul_3)
extrudeAsSolid = Curve.ExtrudeAsSolid(curve=byWidthLength, distance=ceiling_height)

# group: Outputs: Output information that can be used to filter results in Refinery
number_of_windows = Watch(sub)  # graph output
# note: NOTE:
# In order to see an 'Output' in Refinery, you have to right-click on a compatible node and check the 'Is
# Output' option. Rename the node to see a legible output name in Refinery.
floor_area = div * mul_3
floor_area_2 = Watch(floor_area)  # graph output

# group: Window Parameters
faces = Topology.Faces(topology=extrudeAsSolid)
surfaceGeometry = Face.SurfaceGeometry(face=faces)
perimeterCurves = Surface.PerimeterCurves(surface=surfaceGeometry)
code_block = CodeBlock { 5; }
getItemAtIndex = List.GetItemAtIndex(list=perimeterCurves, index=code_block)
code_block_2 = CodeBlock { 0; }
getItemAtIndex_2 = List.GetItemAtIndex(list=getItemAtIndex, index=code_block_2)
number_5 = DoubleInput(2)
mul_4 = ceiling_height * number_5
window_diameter = DoubleInput(6)
window_spacing_on_center = mul_4 - window_diameter
divideCurveByDistance = Geometry.Curves.DivideCurveByDistance(curve=getItemAtIndex_2, Distance=window_spacing_on_center)
ZAxis = Vector.ZAxis()
number_6 = DoubleInput(6)
translate = Geometry.Translate(geometry=divideCurveByDistance.Points, direction=ZAxis, distance=number_6)
number_7 = DoubleInput(3)
byCenterPointRadius = Circle.ByCenterPointRadius(centerPoint=translate, radius=number_7)
YAxis = Vector.YAxis()
number_8 = DoubleInput(90)
rotate = Geometry.Rotate(geometry=byCenterPointRadius, origin=translate, axis=YAxis, degrees=number_8)
code_block_3 = CodeBlock { 5; }
getItemAtIndex_3 = List.GetItemAtIndex(list=perimeterCurves, index=code_block_3)
code_block_4 = CodeBlock { 2; }
getItemAtIndex_4 = List.GetItemAtIndex(list=getItemAtIndex_3, index=code_block_4)
divideCurveByDistance_2 = Geometry.Curves.DivideCurveByDistance(curve=getItemAtIndex_4, Distance=window_spacing_on_center)
ZAxis_2 = Vector.ZAxis()
number_9 = DoubleInput(6)
translate_2 = Geometry.Translate(geometry=divideCurveByDistance_2.Points, direction=ZAxis_2, distance=number_9)
number_10 = DoubleInput(3)
byCenterPointRadius_2 = Circle.ByCenterPointRadius(centerPoint=translate_2, radius=number_10)
YAxis_2 = Vector.YAxis()
number_11 = DoubleInput(90)
rotate_2 = Geometry.Rotate(geometry=byCenterPointRadius_2, origin=translate_2, axis=YAxis_2, degrees=number_11)
list_create = List.Create(item0=rotate, item1=rotate_2)

# group: Visualization: Colourizes Dynamo geometry in the Background Preview window
color_palette = ColorPalette({R: 5, G: 195, B: 222, A: 255})
byGeometryColor = Modifiers.GeometryColor.ByGeometryColor(geometry=surfaceGeometry, color=color_palette)
color_palette_2 = ColorPalette({R: 255, G: 138, B: 61, A: 255})
byGeometryColor_2 = Modifiers.GeometryColor.ByGeometryColor(geometry=list_create, color=color_palette_2)
