# Dynamo graph RFNRY-ADSK-SA-XX-GR-Z-0013 Views2Direction.dyn "13-Views2Direction" (Dynamo 2.0.2.6660)

# group: VIEWS 2DIRECTIONS Refinery Graph Example
# note: DYNAMO PROJECT
# REFINERY_VIEWS_2DIRECTIONS
# note: ASSOCIATED FILE(S)
# N/A
# note: AUTHOR(S) / CREATION DATE
# Refinery Team and The Proving Ground / Dec 2018
# note: DYNAMO VERSION
# 2.0.2
# note: ADDITIONAL COMMENTS
# N/A
# note: REQUIRED DYNAMO PACKAGES
# Lunchbox for Dynamo - v2018.7.6
# Note:
# The Lunchbox installation instructions are now the txt file in the Extra folder. To install Lunchbox you have to use an external installer in liue of the Package Manager.
# note: DESCRIPTION
# This can be a great tool for architects who are developing a complex of buildings either on a single site or on multiple sites in close vicinity and wish to maximize views in multiple directions for all buildings.
# A city block is being built with multiple buildings, each with their own lot size in which each building can move around. There are great view points both to the north and to the east of the block. What is the optimal arrangement of these buildings on their respective plots so that each building can have maximized views in both directions?

# group: Geometry [Dynamo]: Points North View
number_slider = DoubleSlider(-100, range=-200..50 step 1)
number_slider_2 = DoubleSlider(5, range=-50..50 step 1)
code_block = CodeBlock(x=number_slider, y=number_slider_2) { Point.ByCoordinates(x,y,0..48..12); }

# group: Inputs: Changeable variables
# note: Variables / Inputs
# Red indicates Variables that can be altered per project and must be set accordingly before running the script.
# note: NOTE:
# In order to see an 'Input' in Refinery, you have to right-click on a compatible node and check the 'Is Input' option. Rename the node to see a legible input name in Refinery.
X = DoubleSlider(-6.688981945, range=-10..9.391491628 step 1)  # "G1.X"; graph input
# note: Working / Functions
# Green indicates the working of the script. No changes should be made in these groups unless advised.
Y = DoubleSlider(-4.970060034, range=-5..5 step 1)  # "G1.Y"; graph input
X_2 = DoubleSlider(1.872959395, range=-5..6 step 1)  # "G4.X"; graph input
Y_2 = DoubleSlider(48.70046606, range=42..52 step 1)  # "G4.Y"; graph input
X_3 = DoubleSlider(30.57407526, range=28..38 step 1)  # "G2.X"; graph input
# note: Checking / Outputs
# Orange indicates checking nodes to ensure the script has deployed correctly.
Y_3 = DoubleSlider(-13.97717669, range=-18..0 step 1)  # "G2.Y"; graph input
X_4 = DoubleSlider(28.83908322, range=28..38 step 1)  # "G5.X"; graph input
Y_4 = DoubleSlider(42.5755204, range=42..52 step 1)  # "G5.Y"; graph input
X_5 = DoubleSlider(56.15844572, range=56..66 step 1)  # "G6.X"; graph input
Y_5 = DoubleSlider(50.17528807, range=42..52 step 1)  # "G6.Y"; graph input
X_6 = DoubleSlider(66.41829621, range=58..68 step 1)  # "G3.X"; graph input
Y_6 = DoubleSlider(-2.968811012, range=-5..10 step 1)  # "G3.Y"; graph input

# group: Geometry [Dynamo]: Creating 'Building 01' box and translating it's position based on slider inputs
byCoordinates = Point.ByCoordinates()
width = DoubleSlider(22, range=0..100 step 1)
length = DoubleSlider(18, range=0..100 step 1)
number = DoubleInput(60)
byCoordinates_2 = Point.ByCoordinates(x=width, y=length, z=number)
byCorners = Cuboid.ByCorners(lowPoint=byCoordinates, highPoint=byCoordinates_2)
translate = Geometry.Translate(geometry=byCorners, xTranslation=X, yTranslation=Y)

# group: Geometry [Dynamo]: Creating 'Building 04' box and translating it's position based on slider inputs
byCoordinates_3 = Point.ByCoordinates()
width_2 = DoubleSlider(13, range=0..100 step 1)
length_2 = DoubleSlider(27, range=0..100 step 1)
number_2 = DoubleInput(60)
byCoordinates_4 = Point.ByCoordinates(x=width_2, y=length_2, z=number_2)
byCorners_2 = Cuboid.ByCorners(lowPoint=byCoordinates_3, highPoint=byCoordinates_4)
translate_2 = Geometry.Translate(geometry=byCorners_2, xTranslation=X_2, yTranslation=Y_2)

# group: Geometry [Dynamo]: North Direction - Front Group
faces = Topology.Faces(topology=translate)
code_block_2 = CodeBlock { 3; }
getItemAtIndex = List.GetItemAtIndex(list=faces, index=code_block_2)
code_block_3 = CodeBlock { 0; }
getItemAtIndex_2 = List.GetItemAtIndex(list=getItemAtIndex, index=code_block_3)
surfaceGeometry = Face.SurfaceGeometry(face=getItemAtIndex_2)
code_block_4 = CodeBlock { 1; }
thicken = Surface.Thicken(surface=surfaceGeometry, thickness=code_block_4)
faces_2 = Topology.Faces(topology=translate_2)
code_block_5 = CodeBlock { 3; }
getItemAtIndex_3 = List.GetItemAtIndex(list=faces_2, index=code_block_5)
code_block_6 = CodeBlock { 0; }
getItemAtIndex_4 = List.GetItemAtIndex(list=getItemAtIndex_3, index=code_block_6)
surfaceGeometry_2 = Face.SurfaceGeometry(face=getItemAtIndex_4)
code_block_7 = CodeBlock { 1; }
thicken_2 = Surface.Thicken(surface=surfaceGeometry_2, thickness=code_block_7)
front_group = List.Create(item0=thicken, item1=thicken_2)

# group: Geometry [Dynamo]: Calculate Rays that do not hit front row
code_block_8 = CodeBlock { 260; -50; 60; 200; }
# note: We are assuming the both East and North View Points are visible from fron buildings. Therefore, we only calculate the number of rays that hits middle and back rows of buildings.
# 1- First we count the number of rays that does not hit front row.
# 2- claculate the nmber of rays from list above that hit middle row.
# 3 calculate the numbe rof rows that hit back row.
createIsovist = Geometry.Intersection.CreateIsovist(origin=code_block, radius=code_block_8.out0, startAngle=code_block_8.out1, endAngle=code_block_8.out2, rayCount=code_block_8.out3, boundaries=front_group)
length_3 = Curve.Length(curve=createIsovist.Rays)
code_block_9 = CodeBlock(x=length_3, y=createIsovist.Rays) { x!=260?null:y; }
list_create = List.Create(item0=code_block_9)
code_block_10 = CodeBlock { false; }
clean = List.Clean(list=list_create, preserveIndices=code_block_10)
flatten = List.Flatten(list=clean)

# group: Geometry [Dynamo]: Creating 'Building 02' box and translating it's position based on slider inputs
byCoordinates_5 = Point.ByCoordinates()
width_3 = DoubleSlider(22, range=0..100 step 1)
length_4 = DoubleSlider(37, range=0..100 step 1)
number_3 = DoubleInput(60)
byCoordinates_6 = Point.ByCoordinates(x=width_3, y=length_4, z=number_3)
byCorners_3 = Cuboid.ByCorners(lowPoint=byCoordinates_5, highPoint=byCoordinates_6)
translate_3 = Geometry.Translate(geometry=byCorners_3, xTranslation=X_3, yTranslation=Y_3)

# group: Geometry [Dynamo]: Creating 'Building 05' box and translating it's position based on slider inputs
byCoordinates_7 = Point.ByCoordinates()
width_4 = DoubleSlider(18, range=0..100 step 1)
length_5 = DoubleSlider(35, range=0..100 step 1)
number_4 = DoubleInput(60)
byCoordinates_8 = Point.ByCoordinates(x=width_4, y=length_5, z=number_4)
byCorners_4 = Cuboid.ByCorners(lowPoint=byCoordinates_7, highPoint=byCoordinates_8)
translate_4 = Geometry.Translate(geometry=byCorners_4, xTranslation=X_4, yTranslation=Y_4)

# group: Geometry [Dynamo]: North Direction - Middle Group
faces_3 = Topology.Faces(topology=translate_3)
code_block_11 = CodeBlock { 3; }
getItemAtIndex_5 = List.GetItemAtIndex(list=faces_3, index=code_block_11)
code_block_12 = CodeBlock { 0; }
getItemAtIndex_6 = List.GetItemAtIndex(list=getItemAtIndex_5, index=code_block_12)
surfaceGeometry_3 = Face.SurfaceGeometry(face=getItemAtIndex_6)
code_block_13 = CodeBlock { 1; }
thicken_3 = Surface.Thicken(surface=surfaceGeometry_3, thickness=code_block_13)
faces_4 = Topology.Faces(topology=translate_4)
code_block_14 = CodeBlock { 3; }
getItemAtIndex_7 = List.GetItemAtIndex(list=faces_4, index=code_block_14)
code_block_15 = CodeBlock { 0; }
getItemAtIndex_8 = List.GetItemAtIndex(list=getItemAtIndex_7, index=code_block_15)
surfaceGeometry_4 = Face.SurfaceGeometry(face=getItemAtIndex_8)
code_block_16 = CodeBlock { 1; }
thicken_4 = Surface.Thicken(surface=surfaceGeometry_4, thickness=code_block_16)
middle_group = List.Create(item0=thicken_3, item1=thicken_4)

# group: Calculate rays that hit middle row
byUnion = Solid.ByUnion(solids=middle_group)
doesIntersect = Geometry.DoesIntersect(geometry=flatten, other=byUnion)
flatten_2 = List.Flatten(list=doesIntersect)
filterByBoolMask = List.FilterByBoolMask(list=flatten, mask=flatten_2)

# group: Geometry [Dynamo]: Creating 'Building 06' box and translating it's position based on slider inputs
byCoordinates_9 = Point.ByCoordinates()
width_5 = DoubleSlider(28, range=0..100 step 1)
length_6 = DoubleSlider(54, range=0..100 step 1)
number_5 = DoubleInput(60)
byCoordinates_10 = Point.ByCoordinates(x=width_5, y=length_6, z=number_5)
byCorners_5 = Cuboid.ByCorners(lowPoint=byCoordinates_9, highPoint=byCoordinates_10)
translate_5 = Geometry.Translate(geometry=byCorners_5, xTranslation=X_5, yTranslation=Y_5)

# group: Geometry [Dynamo]: Creating 'Building 03' box and translating it's position based on slider inputs
byCoordinates_11 = Point.ByCoordinates()
width_6 = DoubleSlider(20, range=0..100 step 1)
length_7 = DoubleSlider(26, range=0..100 step 1)
number_6 = DoubleInput(60)
byCoordinates_12 = Point.ByCoordinates(x=width_6, y=length_7, z=number_6)
byCorners_6 = Cuboid.ByCorners(lowPoint=byCoordinates_11, highPoint=byCoordinates_12)
translate_6 = Geometry.Translate(geometry=byCorners_6, xTranslation=X_6, yTranslation=Y_6)

# group: Geometry [Dynamo]: North Direction - Back Group
faces_5 = Topology.Faces(topology=translate_5)
code_block_17 = CodeBlock { 3; }
getItemAtIndex_9 = List.GetItemAtIndex(list=faces_5, index=code_block_17)
code_block_18 = CodeBlock { 0; }
getItemAtIndex_10 = List.GetItemAtIndex(list=getItemAtIndex_9, index=code_block_18)
surfaceGeometry_5 = Face.SurfaceGeometry(face=getItemAtIndex_10)
code_block_19 = CodeBlock { 1; }
thicken_5 = Surface.Thicken(surface=surfaceGeometry_5, thickness=code_block_19)
faces_6 = Topology.Faces(topology=translate_6)
code_block_20 = CodeBlock { 3; }
getItemAtIndex_11 = List.GetItemAtIndex(list=faces_6, index=code_block_20)
code_block_21 = CodeBlock { 0; }
getItemAtIndex_12 = List.GetItemAtIndex(list=getItemAtIndex_11, index=code_block_21)
surfaceGeometry_6 = Face.SurfaceGeometry(face=getItemAtIndex_12)
code_block_22 = CodeBlock { 1; }
thicken_6 = Surface.Thicken(surface=surfaceGeometry_6, thickness=code_block_22)
back_group = List.Create(item0=thicken_5, item1=thicken_6)

# group: Calculate rays that hit back row
byUnion_2 = Solid.ByUnion(solids=back_group)
doesIntersect_2 = Geometry.DoesIntersect(geometry=filterByBoolMask.out, other=byUnion_2)
flatten_3 = List.Flatten(list=doesIntersect_2)
filterByBoolMask_2 = List.FilterByBoolMask(list=filterByBoolMask.out, mask=flatten_3)

# group: Data: Counting all rays that only hits middle or back row
count = List.Count(list=filterByBoolMask.in)
count_2 = List.Count(list=filterByBoolMask_2.in)
add = count + count_2

# group: Geometry [Dynamo]: Points East View
number_slider_3 = DoubleSlider(45, range=0..200 step 1)
number_slider_4 = DoubleSlider(-150, range=-200..100 step 1)
code_block_23 = CodeBlock(x=number_slider_3, y=number_slider_4) { Point.ByCoordinates(x,y,0..48..12); }

# group: Geometry [Dynamo]: East Direction - Front Buildings
faces_7 = Topology.Faces(topology=translate_3)
code_block_24 = CodeBlock { 2; }
getItemAtIndex_13 = List.GetItemAtIndex(list=faces_7, index=code_block_24)
surfaceGeometry_7 = Face.SurfaceGeometry(face=getItemAtIndex_13)
code_block_25 = CodeBlock { 1; }
thicken_7 = Surface.Thicken(surface=surfaceGeometry_7, thickness=code_block_25)
faces_8 = Topology.Faces(topology=translate)
getItemAtIndex_14 = List.GetItemAtIndex(list=faces_8, index=code_block_24)
surfaceGeometry_8 = Face.SurfaceGeometry(face=getItemAtIndex_14)
thicken_8 = Surface.Thicken(surface=surfaceGeometry_8, thickness=code_block_25)
faces_9 = Topology.Faces(topology=translate_6)
getItemAtIndex_15 = List.GetItemAtIndex(list=faces_9, index=code_block_24)
surfaceGeometry_9 = Face.SurfaceGeometry(face=getItemAtIndex_15)
thicken_9 = Surface.Thicken(surface=surfaceGeometry_9, thickness=code_block_25)
front_buildings = List.Create(item0=thicken_7, item1=thicken_8, item2=thicken_9)

# group: Geometry [Dynamo]: Calculate Rays that do not hit front row
code_block_26 = CodeBlock { 260; 30; 120; 200; }
# note: We are assuming the both East and North View Points are visible from fron buildings. Therefore, we only calculate the number of rays that hits middle and back rows of buildings.
# 1- First we count the number of rays that does not hit front row.
# 2- claculate the nmber of rays from list above that hit middle row.
# 3 calculate the numbe rof rows that hit back row.
createIsovist_2 = Geometry.Intersection.CreateIsovist(origin=code_block_23, radius=code_block_26.out0, startAngle=code_block_26.out1, endAngle=code_block_26.out2, rayCount=code_block_26.out3, boundaries=front_buildings)
length_8 = Curve.Length(curve=createIsovist_2.Rays)
code_block_27 = CodeBlock(x=length_8, y=createIsovist_2.Rays) { x!=260?null:y; }
list_create_2 = List.Create(item0=code_block_27)
code_block_28 = CodeBlock { false; }
clean_2 = List.Clean(list=list_create_2, preserveIndices=code_block_28)
flatten_4 = List.Flatten(list=clean_2)

# group: Geometry [Dynamo]: East Direction - Back Buildings
faces_10 = Topology.Faces(topology=translate_2)
code_block_29 = CodeBlock { 2; }
getItemAtIndex_16 = List.GetItemAtIndex(list=faces_10, index=code_block_29)
surfaceGeometry_10 = Face.SurfaceGeometry(face=getItemAtIndex_16)
code_block_30 = CodeBlock { 1; }
thicken_10 = Surface.Thicken(surface=surfaceGeometry_10, thickness=code_block_30)
faces_11 = Topology.Faces(topology=translate_4)
getItemAtIndex_17 = List.GetItemAtIndex(list=faces_11, index=code_block_29)
surfaceGeometry_11 = Face.SurfaceGeometry(face=getItemAtIndex_17)
code_block_31 = CodeBlock { 1; }
thicken_11 = Surface.Thicken(surface=surfaceGeometry_11, thickness=code_block_31)
faces_12 = Topology.Faces(topology=translate_5)
getItemAtIndex_18 = List.GetItemAtIndex(list=faces_12, index=code_block_29)
surfaceGeometry_12 = Face.SurfaceGeometry(face=getItemAtIndex_18)
code_block_32 = CodeBlock { 1; }
thicken_12 = Surface.Thicken(surface=surfaceGeometry_12, thickness=code_block_32)
back_buildings = List.Create(item0=thicken_10, item1=thicken_11, item2=thicken_12)

# group: Calculate rays that hit middle row
byUnion_3 = Solid.ByUnion(solids=back_buildings)
doesIntersect_3 = Geometry.DoesIntersect(geometry=flatten_4, other=byUnion_3)
flatten_5 = List.Flatten(list=doesIntersect_3)
filterByBoolMask_3 = List.FilterByBoolMask(list=flatten_4, mask=flatten_5)

# group: Data: Counting all rays that only hits middle or back row
count_3 = List.Count(list=filterByBoolMask_3.in)

# group: Output
# note: NOTE:
# In order to see an 'Output' in Refinery, you have to right-click on a compatible node and check the 'Is
# Output' option. Rename the node to see a legible output name in Refinery.
view_1 = Watch(add)  # graph output
view_2 = Watch(count_3)  # graph output

# group: Visualization: Colourizes Dynamo geometry in the Background Preview window
list_create_3 = List.Create(item0=filterByBoolMask.in, item1=filterByBoolMask_2.in, item2=filterByBoolMask_3.in)
color_palette = ColorPalette({R: 5, G: 195, B: 222, A: 255})
byGeometryColor = Modifiers.GeometryColor.ByGeometryColor(geometry=list_create_3, color=color_palette)
list_create_4 = List.Create(item0=translate, item1=translate_3, item2=translate_6, item3=translate_2, item4=translate_4, item5=translate_5)
color_palette_2 = ColorPalette({R: 255, G: 138, B: 61, A: 255})
byGeometryColor_2 = Modifiers.GeometryColor.ByGeometryColor(geometry=list_create_4, color=color_palette_2)
