# Dynamo graph RFNRY-ADSK-SA-XX-GR-Z-0014 ChoirViews.dyn "14-ChoirViews" (Dynamo 2.0.2.6660)

# group: CHOIR VIEWS: Refinery Graph Example
# note: DYNAMO PROJECT
# REFINERY_CHOIR_VIEWS
# note: ASSOCIATED FILE(S)
# N/A
# note: AUTHOR(S) / CREATION DATE
# Refinery Team and The Proving Ground / Dec 2018
# note: DESCRIPTION
# This example is based on typical church design recommendations for the choir. A set of choir risers is positioned at the front of a room behind the band (Preferred location in front of choir and at center with 20-25 square feet per instrument). The number of riser rows is based on a 12% congregation capacity (capacity is set by the user). Views of the choir from the church pews need to be optimized based on band area rotation, pew aisle width, choir riser incline, choir riser curvature, and pew curvature.
# This can be a good starting point for stage design or church design in which the audience views need to be maximized.
# note: DYNAMO VERSION
# 2.0.2
# note: ADDITIONAL COMMENTS
# N/A
# note: REQUIRED DYNAMO PACKAGES
# Lunchbox for Dynamo - v2018.7.6
# Note:
# The Lunchbox installation instructions are now the txt file in the Extra folder. To install Lunchbox you have to use an external installer in liue of the Package Manager.

# group: Inputs: Changeable variables
congregation_seating_curvature = DoubleSlider(-1.23, range=-1.5..-1 step 0.01)  # graph input
aisle_width = DoubleSlider(8.030452887, range=4..10 step 0.1)  # graph input
# note: Checking / Outputs
# Orange indicates checking nodes to ensure the script has deployed correctly.
riser_curvature = DoubleSlider(1.190595997, range=0.1..1.307454248 step 0.01)  # graph input
# note: Working / Functions
# Green indicates the working of the script. No changes should be made in these groups unless advised.
riser_incline = DoubleSlider(0.42, range=0.25..0.55 step 0.01)  # graph input
# note: Variables / Inputs
# Red indicates Variables that can be altered per project and must be set accordingly before running the script.
# note: NOTE:
# In order to see an 'Input' in Refinery, you have to right-click on a compatible node and check the 'Is Input' option. Rename the node to see a legible input name in Refinery.
band_placement_rotation = DoubleSlider(280.3571856, range=0..360 step 1)  # graph input

# group: Congregation Pews
code_block = CodeBlock { 39; }
code_block_2 = CodeBlock { 1.66; }
row_length = code_block * code_block_2
code_block_3 = CodeBlock { 0.2; }
mul = row_length * code_block_3
code_block_4 = CodeBlock { 4; }
byCoordinates = Point.ByCoordinates(x=row_length, y=mul, z=code_block_4)
mul_2 = row_length * congregation_seating_curvature
add = mul + mul_2
byCoordinates_2 = Point.ByCoordinates(y=add, z=code_block_4)
code_block_5 = CodeBlock { -1; }
mul_3 = row_length * code_block_5
byCoordinates_3 = Point.ByCoordinates(x=mul_3, y=mul, z=code_block_4)
byThreePoints = Arc.ByThreePoints(firstPoint=byCoordinates, secondPoint=byCoordinates_2, thirdPoint=byCoordinates_3)

# group: Choir risers
code_block_6 = CodeBlock { 13; }
code_block_7 = CodeBlock { 1.66; }
row_length_2 = code_block_6 * code_block_7
code_block_8 = CodeBlock { 0.2; }
mul_4 = row_length_2 * code_block_8
code_block_9 = CodeBlock { 1; }
byCoordinates_4 = Point.ByCoordinates(x=row_length_2, y=mul_4, z=code_block_9)
mul_5 = row_length_2 * riser_curvature
add_2 = mul_4 + mul_5
byCoordinates_5 = Point.ByCoordinates(y=add_2, z=code_block_9)
code_block_10 = CodeBlock { -1; }
mul_6 = row_length_2 * code_block_10
byCoordinates_6 = Point.ByCoordinates(x=mul_6, y=mul_4, z=code_block_9)
byThreePoints_2 = Arc.ByThreePoints(firstPoint=byCoordinates_4, secondPoint=byCoordinates_5, thirdPoint=byCoordinates_6)

# group: Choir Riser Array
congregation_capacity = DoubleInput(500)
code_block_11 = CodeBlock { 0.12; }
mul_7 = congregation_capacity * code_block_11
code_block_12 = CodeBlock { 12; }
number_of_rows = mul_7 / code_block_12
watch = Watch(number_of_rows)
code_block_13 = CodeBlock(x=number_of_rows) { y=[0..x]; 3*y; }
offset = Curve.Offset(curve=byThreePoints_2, distance=code_block_13.out1)

# group: Congregation Pew Array
code_block_14 = CodeBlock { 0; 1; }
length = Curve.Length(curve=byThreePoints)
code_block_15 = CodeBlock { 1; }
code_block_16 = CodeBlock { [1,2]; }
mul_8 = code_block_15 * code_block_16
ge = row_length >= mul_8
countTrue = List.CountTrue(list=ge)
code_block_17 = CodeBlock(x=countTrue) { y=(x*2)+2; z=[0..y]; }
div = length / code_block_17.y
mul_9 = div * code_block_17.z
flatten = List.Flatten(list=mul_9)
count = List.Count(list=flatten)
code_block_18 = CodeBlock(x=count) { x-1; x-2; }
removeItemAtIndex = List.RemoveItemAtIndex(list=flatten, indices=code_block_18.out0)
add_3 = removeItemAtIndex + aisle_width
restOfItems = List.RestOfItems(list=flatten)
code_block_19 = CodeBlock(x=restOfItems) { x-2; }
list_create = List.Create(item0=add_3, item1=code_block_19)
transpose = List.Transpose(lists=list_create)
flatten_2 = List.Flatten(list=transpose)
mapTo = Math.MapTo(rangeMin=code_block_14.out0, rangeMax=length, inputValue=flatten_2, targetRangeMin=code_block_14.out0, targetRangeMax=code_block_14.out1)
splitByParameter = Curve.SplitByParameter(curve=byThreePoints, parameters=mapTo)
count_2 = List.Count(list=splitByParameter)
code_block_20 = CodeBlock(x=count_2) { 0.5; [0..(x-1)]; 2; }
takeEveryNthItem = List.TakeEveryNthItem(list=splitByParameter, n=code_block_20.out2)
code_block_21 = CodeBlock { 1; }
getItemAtIndex = List.GetItemAtIndex(list=takeEveryNthItem, index=code_block_21)
code_block_22 = CodeBlock { 4; }
div_2 = congregation_capacity / code_block_22
code_block_23 = CodeBlock { 13; }
number_of_congregation_rows = div_2 / code_block_23
code_block_24 = CodeBlock(x=number_of_congregation_rows) { y=[0..x]; 3*y; }
offset_2 = Curve.Offset(curve=getItemAtIndex, distance=code_block_24.out1)
code_block_25 = CodeBlock { 2; }
getItemAtIndex_2 = List.GetItemAtIndex(list=takeEveryNthItem, index=code_block_25)
offset_3 = Curve.Offset(curve=getItemAtIndex_2, distance=code_block_24.out1)
code_block_26 = CodeBlock { 3; }
getItemAtIndex_3 = List.GetItemAtIndex(list=takeEveryNthItem, index=code_block_26)
offset_4 = Curve.Offset(curve=getItemAtIndex_3, distance=code_block_24.out1)
code_block_27 = CodeBlock { 4; }
getItemAtIndex_4 = List.GetItemAtIndex(list=takeEveryNthItem, index=code_block_27)
offset_5 = Curve.Offset(curve=getItemAtIndex_4, distance=code_block_24.out1)

# group: Extract View Points
flatten_3 = List.Flatten(list=offset_2)
code_block_28 = CodeBlock { 0; }
getItemAtIndex_5 = List.GetItemAtIndex(list=flatten_3, index=code_block_28)
length_2 = Curve.Length(curve=getItemAtIndex_5)
code_block_29 = CodeBlock { 2; }
div_3 = length_2 / code_block_29
divideCurveByDistance = Geometry.Curves.DivideCurveByDistance(curve=getItemAtIndex_5, Distance=div_3)
flatten_4 = List.Flatten(list=offset_2)
code_block_30 = CodeBlock { 9; }
getItemAtIndex_6 = List.GetItemAtIndex(list=flatten_4, index=code_block_30)
length_3 = Curve.Length(curve=getItemAtIndex_6)
code_block_31 = CodeBlock { 2; }
div_4 = length_3 / code_block_31
divideCurveByDistance_2 = Geometry.Curves.DivideCurveByDistance(curve=getItemAtIndex_6, Distance=div_4)
flatten_5 = List.Flatten(list=offset_3)
code_block_32 = CodeBlock { 0; }
getItemAtIndex_7 = List.GetItemAtIndex(list=flatten_5, index=code_block_32)
length_4 = Curve.Length(curve=getItemAtIndex_7)
code_block_33 = CodeBlock { 2; }
div_5 = length_4 / code_block_33
divideCurveByDistance_3 = Geometry.Curves.DivideCurveByDistance(curve=getItemAtIndex_7, Distance=div_5)
flatten_6 = List.Flatten(list=offset_3)
code_block_34 = CodeBlock { 9; }
getItemAtIndex_8 = List.GetItemAtIndex(list=flatten_6, index=code_block_34)
length_5 = Curve.Length(curve=getItemAtIndex_8)
code_block_35 = CodeBlock { 2; }
div_6 = length_5 / code_block_35
divideCurveByDistance_4 = Geometry.Curves.DivideCurveByDistance(curve=getItemAtIndex_8, Distance=div_6)
flatten_7 = List.Flatten(list=offset_4)
code_block_36 = CodeBlock { 0; }
getItemAtIndex_9 = List.GetItemAtIndex(list=flatten_7, index=code_block_36)
length_6 = Curve.Length(curve=getItemAtIndex_9)
code_block_37 = CodeBlock { 2; }
div_7 = length_6 / code_block_37
divideCurveByDistance_5 = Geometry.Curves.DivideCurveByDistance(curve=getItemAtIndex_9, Distance=div_7)
flatten_8 = List.Flatten(list=offset_4)
code_block_38 = CodeBlock { 9; }
getItemAtIndex_10 = List.GetItemAtIndex(list=flatten_8, index=code_block_38)
length_7 = Curve.Length(curve=getItemAtIndex_10)
code_block_39 = CodeBlock { 2; }
div_8 = length_7 / code_block_39
divideCurveByDistance_6 = Geometry.Curves.DivideCurveByDistance(curve=getItemAtIndex_10, Distance=div_8)
flatten_9 = List.Flatten(list=offset_5)
code_block_40 = CodeBlock { 0; }
getItemAtIndex_11 = List.GetItemAtIndex(list=flatten_9, index=code_block_40)
length_8 = Curve.Length(curve=getItemAtIndex_11)
code_block_41 = CodeBlock { 2; }
div_9 = length_8 / code_block_41
divideCurveByDistance_7 = Geometry.Curves.DivideCurveByDistance(curve=getItemAtIndex_11, Distance=div_9)
flatten_10 = List.Flatten(list=offset_5)
code_block_42 = CodeBlock { 9; }
getItemAtIndex_12 = List.GetItemAtIndex(list=flatten_10, index=code_block_42)
length_9 = Curve.Length(curve=getItemAtIndex_12)
code_block_43 = CodeBlock { 2; }
div_10 = length_9 / code_block_43
divideCurveByDistance_8 = Geometry.Curves.DivideCurveByDistance(curve=getItemAtIndex_12, Distance=div_10)

# group: Choir Riser Solid
code_block_44 = CodeBlock { 1; 0; }
flatten_11 = List.Flatten(list=offset, amt=code_block_44.out0)
transpose_2 = List.Transpose(lists=flatten_11)
ZAxis = Vector.ZAxis()
flatten_12 = List.Flatten(list=transpose_2)
count_3 = List.Count(list=flatten_12)
code_block_45 = CodeBlock(x=riser_incline, c=count_3) { y=x*3; a=[0..c]; b=y*a; -y; }
code_block_46 = CodeBlock { 1; }
ofRepeatedItem = List.OfRepeatedItem(item=code_block_45.b, amount=code_block_46)
flatten_13 = List.Flatten(list=ofRepeatedItem)
transpose_3 = List.Transpose(lists=flatten_13)
translate = Geometry.Translate(geometry=transpose_2, direction=ZAxis, distance=transpose_3)
flatten_14 = List.Flatten(list=translate)
translate_2 = Geometry.Translate(geometry=translate, direction=ZAxis, distance=code_block_45.out3)
flatten_15 = List.Flatten(list=translate_2)
list_create_2 = List.Create(item0=flatten_14, item1=flatten_15)
transpose_4 = List.Transpose(lists=list_create_2)
byLoft = Surface.ByLoft(crossSections=transpose_4)
thicken = Surface.Thicken(surface=byLoft)
code_block_47 = CodeBlock(x=code_block_46) { x; -x; }
dropItems = List.DropItems(list=flatten_15, amount=code_block_47.x)
dropItems_2 = List.DropItems(list=flatten_14, amount=code_block_47.out1)
list_create_3 = List.Create(item0=dropItems, item1=dropItems_2)
transpose_5 = List.Transpose(lists=list_create_3)
byLoft_2 = Surface.ByLoft(crossSections=transpose_5)
list_create_4 = List.Create(item0=byLoft, item1=byLoft_2)
byJoinedSurfaces = PolySurface.ByJoinedSurfaces(surfaces=list_create_4)

# group: Isovists and Collision
code_block_48 = CodeBlock { 140; 95; 155; 50; }
createIsovist = Geometry.Intersection.CreateIsovist(origin=divideCurveByDistance.Points, radius=code_block_48.out0, startAngle=code_block_48.out1, endAngle=code_block_48.out2, rayCount=code_block_48.out3, boundaries=thicken)
length_10 = Curve.Length(curve=createIsovist.Rays)
code_block_49 = CodeBlock(x=length_10, y=createIsovist.Rays) { x==140?null:y; }
list_create_5 = List.Create(item0=code_block_49)
removeNulls = Lists.Manage.RemoveNulls(Data=list_create_5)
flatten_16 = List.Flatten(list=removeNulls.Cleaned)
code_block_50 = CodeBlock { 140; 105; 155; 50; }
createIsovist_2 = Geometry.Intersection.CreateIsovist(origin=divideCurveByDistance_2.Points, radius=code_block_50.out0, startAngle=code_block_50.out1, endAngle=code_block_50.out2, rayCount=code_block_50.out3, boundaries=thicken)
length_11 = Curve.Length(curve=createIsovist_2.Rays)
code_block_51 = CodeBlock(x=length_11, y=createIsovist_2.Rays) { x==140?null:y; }
list_create_6 = List.Create(item0=code_block_51)
removeNulls_2 = Lists.Manage.RemoveNulls(Data=list_create_6)
flatten_17 = List.Flatten(list=removeNulls_2.Cleaned)
list_create_7 = List.Create(item0=flatten_16, item1=flatten_17)
flatten_18 = List.Flatten(list=list_create_7)
number_of_instruments_in_band = DoubleSlider(4, range=0..10 step 1)
code_block_52 = CodeBlock { 25; }
mul_10 = number_of_instruments_in_band * code_block_52
sqrt = Math.Sqrt(number=mul_10)
byWidthLength = Rectangle.ByWidthLength(width=sqrt, length=sqrt)
code_block_53 = CodeBlock { 7; }
extrudeAsSolid = Curve.ExtrudeAsSolid(curve=byWidthLength, distance=code_block_53)
byCoordinates_7 = Point.ByCoordinates()
ZAxis_2 = Vector.ZAxis()
rotate = Geometry.Rotate(geometry=extrudeAsSolid, origin=byCoordinates_7, axis=ZAxis_2, degrees=band_placement_rotation)
doesIntersect = Geometry.DoesIntersect(geometry=flatten_18, other=rotate)
countFalse = List.CountFalse(list=doesIntersect)
code_block_54 = CodeBlock { 140; 75; 125; 50; }
createIsovist_3 = Geometry.Intersection.CreateIsovist(origin=divideCurveByDistance_3.Points, radius=code_block_54.out0, startAngle=code_block_54.out1, endAngle=code_block_54.out2, rayCount=code_block_54.out3, boundaries=thicken)
length_12 = Curve.Length(curve=createIsovist_3.Rays)
code_block_55 = CodeBlock(x=length_12, y=createIsovist_3.Rays) { x==140?null:y; }
list_create_8 = List.Create(item0=code_block_55)
removeNulls_3 = Lists.Manage.RemoveNulls(Data=list_create_8)
flatten_19 = List.Flatten(list=removeNulls_3.Cleaned)
code_block_56 = CodeBlock { 140; 75; 125; 50; }
createIsovist_4 = Geometry.Intersection.CreateIsovist(origin=divideCurveByDistance_4.Points, radius=code_block_56.out0, startAngle=code_block_56.out1, endAngle=code_block_56.out2, rayCount=code_block_56.out3, boundaries=thicken)
length_13 = Curve.Length(curve=createIsovist_4.Rays)
code_block_57 = CodeBlock(x=length_13, y=createIsovist_4.Rays) { x==140?null:y; }
list_create_9 = List.Create(item0=code_block_57)
removeNulls_4 = Lists.Manage.RemoveNulls(Data=list_create_9)
flatten_20 = List.Flatten(list=removeNulls_4.Cleaned)
list_create_10 = List.Create(item0=flatten_19, item1=flatten_20)
flatten_21 = List.Flatten(list=list_create_10)
doesIntersect_2 = Geometry.DoesIntersect(geometry=flatten_21, other=rotate)
countFalse_2 = List.CountFalse(list=doesIntersect_2)
code_block_58 = CodeBlock { 140; 45; 110; 50; }
createIsovist_5 = Geometry.Intersection.CreateIsovist(origin=divideCurveByDistance_5.Points, radius=code_block_58.out0, startAngle=code_block_58.out1, endAngle=code_block_58.out2, rayCount=code_block_58.out3, boundaries=thicken)
length_14 = Curve.Length(curve=createIsovist_5.Rays)
code_block_59 = CodeBlock(x=length_14, y=createIsovist_5.Rays) { x==140?null:y; }
list_create_11 = List.Create(item0=code_block_59)
removeNulls_5 = Lists.Manage.RemoveNulls(Data=list_create_11)
flatten_22 = List.Flatten(list=removeNulls_5.Cleaned)
code_block_60 = CodeBlock { 140; 45; 110; 50; }
createIsovist_6 = Geometry.Intersection.CreateIsovist(origin=divideCurveByDistance_6.Points, radius=code_block_60.out0, startAngle=code_block_60.out1, endAngle=code_block_60.out2, rayCount=code_block_60.out3, boundaries=thicken)
length_15 = Curve.Length(curve=createIsovist_6.Rays)
code_block_61 = CodeBlock(x=length_15, y=createIsovist_6.Rays) { x==140?null:y; }
list_create_12 = List.Create(item0=code_block_61)
removeNulls_6 = Lists.Manage.RemoveNulls(Data=list_create_12)
flatten_23 = List.Flatten(list=removeNulls_6.Cleaned)
list_create_13 = List.Create(item0=flatten_22, item1=flatten_23)
flatten_24 = List.Flatten(list=list_create_13)
doesIntersect_3 = Geometry.DoesIntersect(geometry=flatten_24, other=rotate)
countFalse_3 = List.CountFalse(list=doesIntersect_3)
code_block_62 = CodeBlock { 140; 25; 90; 50; }
createIsovist_7 = Geometry.Intersection.CreateIsovist(origin=divideCurveByDistance_7.Points, radius=code_block_62.out0, startAngle=code_block_62.out1, endAngle=code_block_62.out2, rayCount=code_block_62.out3, boundaries=thicken)
length_16 = Curve.Length(curve=createIsovist_7.Rays)
code_block_63 = CodeBlock(x=length_16, y=createIsovist_7.Rays) { x==140?null:y; }
list_create_14 = List.Create(item0=code_block_63)
removeNulls_7 = Lists.Manage.RemoveNulls(Data=list_create_14)
flatten_25 = List.Flatten(list=removeNulls_7.Cleaned)
code_block_64 = CodeBlock { 140; 25; 70; 50; }
createIsovist_8 = Geometry.Intersection.CreateIsovist(origin=divideCurveByDistance_8.Points, radius=code_block_64.out0, startAngle=code_block_64.out1, endAngle=code_block_64.out2, rayCount=code_block_64.out3, boundaries=thicken)
length_17 = Curve.Length(curve=createIsovist_8.Rays)
code_block_65 = CodeBlock(x=length_17, y=createIsovist_8.Rays) { x==140?null:y; }
list_create_15 = List.Create(item0=code_block_65)
removeNulls_8 = Lists.Manage.RemoveNulls(Data=list_create_15)
flatten_26 = List.Flatten(list=removeNulls_8.Cleaned)
list_create_16 = List.Create(item0=flatten_25, item1=flatten_26)
flatten_27 = List.Flatten(list=list_create_16)
doesIntersect_4 = Geometry.DoesIntersect(geometry=flatten_27, other=rotate)
countFalse_4 = List.CountFalse(list=doesIntersect_4)

# group: Output
view_1 = Watch(countFalse)  # graph output
# note: NOTE:
# In order to see an 'Output' in Refinery, you have to right-click on a compatible node and check the 'Is
# Output' option. Rename the node to see a legible output name in Refinery.
riser_incline_2 = Watch(riser_incline)  # graph output
view_2 = Watch(countFalse_2)  # graph output
view_3 = Watch(countFalse_3)  # graph output
view_4 = Watch(countFalse_4)  # graph output

# group: Visualization: Colourizes Dynamo geometry in the Background Preview window
list_create_17 = List.Create(item0=flatten_18, item1=flatten_21, item2=flatten_24, item3=flatten_27)
code_block_66 = CodeBlock { transparentBlue = DSCore.Color.ByARGB(100,5,195,222); }
byGeometryColor = Modifiers.GeometryColor.ByGeometryColor(geometry=list_create_17, color=code_block_66)
list_create_18 = List.Create(item0=thicken, item1=byJoinedSurfaces, item2=offset_2, item3=offset_3, item4=offset_4, item5=offset_5, item6=rotate)
flatten_28 = List.Flatten(list=list_create_18)
color_palette = ColorPalette({R: 255, G: 138, B: 61, A: 255})
byGeometryColor_2 = Modifiers.GeometryColor.ByGeometryColor(geometry=flatten_28, color=color_palette)
