# Dynamo graph RFNRY-ADSK-SA-XX-GR-Z-0022 GenerateFloorPlan.dyn "GenerateFloorPlan -OTx" (Dynamo 2.0.2.6826)

# group: Required Packages: -Lunchbox (install from https://provingground.io/tools/lunchbox/) -Steamnodes -Dynamo Text Place packages in C:\Users\username\AppData\Roaming\Dynamo\Dynamo Core\2.0\packages (and similar for Revit) nth permutation.dyf must be in C:\Users\username\AppData\Roaming\Dynamo\Dynamo Core\2.0\definitions folder to run in Refinery Machine must also have Excel installed to read the program.
# note: ....

# group: Enable/disable downstream content to expedite evaluations.
evaluate_design = BoolSelector(true)
create_revit_content = BoolSelector(false)

# group: Bring in the Program
file_path = Filename(".\Simple.xlsx")
file_from_path = FileObject(path=file_path)
code_block = CodeBlock { "Sheet1"; false; }
importExcel = Data.ImportExcel(file=file_from_path, sheetName=code_block.out0, showExcel=code_block.out1)
code_block_2 = CodeBlock { 1; }
dropItems = List.DropItems(list=importExcel, amount=code_block_2)
transpose = List.Transpose(lists=dropItems)

# group: Get the headers - these will be your dictionary keys.
firstItem = List.FirstItem(list=importExcel)

# group: Build colors from the color values
code_block_3 = CodeBlock(a=transpose) { a[4]; }
string = StringInput(",")
split = String.Split(str=code_block_3, separater0=string)
transpose_2 = List.Transpose(lists=split)
code_block_4 = CodeBlock(a=transpose_2) { 128; String.ToNumber(a[0]); String.ToNumber(a[1]); String.ToNumber(a[2]); }
byARGB = Color.ByARGB(a=code_block_4.out0, r=code_block_4.out1, g=code_block_4.out2, b=code_block_4.out3)

# group: Replace our color values with the produced colors.
code_block_5 = CodeBlock { 4; }
replaceItemAtIndex = List.ReplaceItemAtIndex(list=transpose, index=code_block_5, item=byARGB)

# group: Remove the hallway and select just the hallway data.
firstItem_2 = List.FirstItem(list=replaceItemAtIndex@L2)
code_block_6 = CodeBlock { 1; }
dropItems_2 = List.DropItems(list=replaceItemAtIndex@L2, amount=code_block_6)

# group: This is our data from excel
identity = Object.Identity(obj=firstItem_2)

# group: Configure the input The max is one less than the upper limit of the design space. In this case I have 10 items I'm shuffling, which means: Max = 10! - 1 = 3628799
# note: Remeber your program will be different so that value will change.
configuration = IntegerSlider(2039412, range=2039212..2039612 step 1)  # graph input

list_create = List.Create(item0=configuration)

# group: Custom node to get the nth permutation lexocographical order.
code_block_7 = CodeBlock(a=dropItems_2) { a[0]; }
# note: Custom Node: Jacob Small
nth_permutation = Custom[nth permutation](ListToPermutate=code_block_7, PermutationList=list_create)  # Finds the lexicographically ordered permutation at the given index without calculating all permutations in the set.

# group: Sort each sublist by the permutation of the space numbers
sortByKey = List.SortByKey(list=dropItems_2@L2, keys=nth_permutation.ReorderedList)

addItemToFront = List.AddItemToFront(item=identity@L1, list=sortByKey.sorted_list@L2)

# group: Build a dictionary from the various values
byKeysValues = DesignScript.Builtin.Dictionary.ByKeysValues(keys=firstItem, values=addItemToFront)

# group: Build a rectangle for all spaces (except the hallway).
code_block_8 = CodeBlock { "AREA"; }
valueAtKey = DesignScript.Builtin.Dictionary.ValueAtKey(dictionary=byKeysValues, key=code_block_8)
code_block_9 = CodeBlock { 1; }
dropItems_3 = List.DropItems(list=valueAtKey, amount=code_block_9)
sqrt = Math.Sqrt(number=dropItems_3)
byWidthLength = Rectangle.ByWidthLength(width=sqrt, length=sqrt)

# group: Gets the hallway data (I kept that first in the list) and pulls the area and divdes by 3 (assuming 3' wide hallway)
code_block_10 = CodeBlock(a=identity) { a[3]/3; 3; }
byWidthLength_2 = Rectangle.ByWidthLength(width=code_block_10.out0, length=code_block_10.out1)

# group: appends the hallway
addItemToEnd = List.AddItemToEnd(item=byWidthLength, list=byWidthLength_2)
flatten = List.Flatten(list=addItemToEnd)

# group: add the rectangles to the dictionary
code_block_11 = CodeBlock { "SpaceShape"; }
setValueAtKeys = DesignScript.Builtin.Dictionary.SetValueAtKeys(dictionary=byKeysValues, keys=code_block_11, values=flatten@L3)

# group: Count the number of spaces and divide by two, filtering out any resulting nulls
count = List.Count(list=byWidthLength@L2)
code_block_12 = CodeBlock { 2; }
div = count / code_block_12
chop = List.Chop(list=byWidthLength@L2, lengths=div)
boolean = BoolSelector(false)
clean = List.Clean(list=chop, preserveIndices=boolean)

# group: Divide the width by two, and the height by either [2,-2] and move the rectangles by this distance.
width = Rectangle.Width(rectangle=clean)
code_block_13 = CodeBlock(x=width) { x/2; }
height = Rectangle.Height(rectangle=clean)
code_block_14 = CodeBlock(y=height) { (y@L2<1>/[2,-2]@L1<1>)+[1.5,-1.5]; }
translate = Geometry.Translate(geometry=clean@L2, xTranslation=code_block_13@L2, yTranslation=code_block_14@L2)

# group: Get the partial sums of all the widths
# note: Custom Node: LunchBox
#     v.2018.7.6
lunchbox_mass_addition = Custom[LunchBox Mass Addition](Numbers=width@L2)  # Returns the total value of a list of numbers.

# group: Add a 0 to the front and move the rectangles by the partial sums
code_block_15 = CodeBlock { 0; }
addItemToFront_2 = List.AddItemToFront(item=code_block_15, list=lunchbox_mass_addition.Partials@L2)
translate_2 = Geometry.Translate(geometry=translate@L2, xTranslation=addItemToFront_2@L2)

# group: Flatten the list and find the midpoint of all the sapces.
flatten_2 = List.Flatten(list=translate_2)
byGeometry = BoundingBox.ByGeometry(geom=flatten_2)
code_block_16 = CodeBlock(boundingBox1=byGeometry) { BoundingBox.MaxPoint(boundingBox1).X/2; }

# group: This is the hall shape from before
identity_2 = Object.Identity(obj=byWidthLength_2)

# group: Place the hallway at the midpoint and add it into the list of placed shapes, flatten the combined list, and create a surface for each.
translate_3 = Geometry.Translate(geometry=identity_2, xTranslation=code_block_16)
addItemToEnd_2 = List.AddItemToEnd(item=flatten_2@L2, list=translate_3@L1)
flatten_3 = List.Flatten(list=addItemToEnd_2)
byPatch = Surface.ByPatch(closedCurve=flatten_3)

# group: Add the space location (surface) to the overall dictionary and flatten it. Generation is done time to evaluate.
string_2 = StringInput("SpaceLocation")
setValueAtKeys_2 = DesignScript.Builtin.Dictionary.SetValueAtKeys(dictionary=setValueAtKeys, keys=string_2, values=byPatch@L3)
flatten_4 = List.Flatten(list=setValueAtKeys_2)

# group: Gather data for evaluation methods
string_3 = StringInput("SPACE NAME")
string_4 = StringInput("COLOUR")
string_5 = StringInput("SpaceLocation")
string_6 = StringInput("ADJACENT SPACES")
string_7 = StringInput("NOISE")
list_create_2 = List.Create(item0=string_3, item1=string_4, item2=string_5, item3=string_6, item4=string_7)
valueAtKey_2 = DesignScript.Builtin.Dictionary.ValueAtKey(dictionary=flatten_4, key=list_create_2, lacing=Longest)
runMe = Custom[Tool.RunMe](Boolean=evaluate_design, ThingToDo=valueAtKey_2)  # Use Boolean to perform an action

# group: Use clodeblocks to make it easier to track your data flow. Criss -crossing spagetthi is bad.
code_block_17 = CodeBlock(a=runMe)
# ---------- code_block_17.designscript (102 lines) ----------
names =
	a[0];
spaces =
	a[2];



colors =
	a[1];

















spaces;





names;
adjacencies =
	a[3];







































NoiseTargets =
	a[4];
spaces;
























NoiseTargets;
# ----------------------------------------

# group: Create a meaningful geometry display so you can visualize the resulting layout.
byGeometryColor = Modifiers.GeometryColor.ByGeometryColor(geometry=code_block_17.out1, color=code_block_17.out2)
number = DoubleInput(0.25)
number_2 = DoubleInput(0.5)
pointAtParameter = Surface.PointAtParameter(surface=code_block_17.out1, u=number, v=number_2)
number_3 = DoubleInput(2)
# note: Custom Node: DynamoText v.2.0.1
fromStringOriginAndScale = DynamoText.Text.FromStringOriginAndScale(text=code_block_17.out0, origin=pointAtParameter, scale=number_3)
perimeterCurves = Surface.PerimeterCurves(surface=code_block_17.out3)

# group: This is the python contained in the "nth permutation" node.
string_8 = StringInput("""import clr
clr.AddReference('ProtoGeometry')
from Autodesk.DesignScript.Geometry import *
from math import *

def from_rank(rank, lst):
    my_lst = sorted(lst)
    ret = []
    while my_lst:
        fact = factorial(len(my_lst) - 1)
        idx, rank = divmod(rank, fact)
        ret.append(my_lst.pop(idx))
    assert rank == 0  # invalid rank - out of range
    return ret

lista = IN[1]
count = len(lista)
powers = range(0,count)
listb = []

for p in powers:
	listb.append(pow(1000000000,p))

rank = sum([a*b for a,b in zip(lista,listb)])

lst = IN[0]

maxrank = factorial(len(lst))-1

if rank > maxrank:
	adjustrank = maxrank
else:
	adjustrank = rank

perm = from_rank(adjustrank,lst)

OUT = [maxrank, rank, adjustrank, perm]""")

# group: Generate Revit elements (rooms and room separation lines)
levels = Levels(index=0)
runMe_2 = Custom[Tool.RunMe](Boolean=create_revit_content, ThingToDo=flatten_4)
string_9 = StringInput("SpaceLocation")
string_10 = StringInput("SPACE NAME")
string_11 = StringInput("SPACE ID")
list_create_3 = List.Create(item0=string_9, item1=string_10, item2=string_11)
valueAtKey_3 = DesignScript.Builtin.Dictionary.ValueAtKey(dictionary=runMe_2, key=list_create_3, lacing=Longest)
code_block_18 = CodeBlock(a=valueAtKey_3) { a[0]; a[1]; a[2]; a[0]; }
number_4 = DoubleInput(0.5)
pointAtParameter_2 = Surface.PointAtParameter(surface=code_block_18.out0, u=number_4, v=number_4)
string_from_object = FromObject(obj=code_block_18.out2)
perimeterCurves_2 = Surface.PerimeterCurves(surface=code_block_18.out3)
current = Document.Current()
activeView = Document.ActiveView(document=current)
plane = Custom[View.Plane](view=activeView)  # Retrieves the plane of a given view
byPlane = SketchPlane.ByPlane(plane=plane)
fromCurve = Custom[RoomSeparator.FromCurve](curve=perimeterCurves_2, sketchPlane=byPlane, view=activeView)  # Creates room separation lines from geometry curves.
passthrough = Custom[Passthrough](passThrough=string_from_object, waitFor=fromCurve)  # Forces a sequential order of execution. The node wired into the output of the Passthrough node will be executed *after* the node wired into the waitFor input (e.g. important for some Revit operations). The value of the passThrough input will be passed on to the node wired into the output port of the Passthrough node.
byLocation = Room.ByLocation(level=levels, location=pointAtParameter_2, name=code_block_18.out1, number=passthrough)

designs_i_ve_found_which_are = CodeBlock()  # "Designs I've found which are nice."
# ---------- designs_i_ve_found_which_are.designscript (8 lines) ----------
1851083;
1834100;
1572587;
1693780;
//my favorite:
				2039412;
2039413;
397420;
# ----------------------------------------

# group: Find the distance from each room to the required adjacent room per the excel spreadsheet.
code_block_19 = CodeBlock { ", "; }
split_2 = String.Split(str=code_block_17.out5, separater0=code_block_19)
indexOf = List.IndexOf(list=code_block_17.out4@L2, element=split_2)
getItemAtIndex = List.GetItemAtIndex(list=code_block_17.out3@L2, index=indexOf@L3)
distanceTo = Geometry.DistanceTo(geometry=code_block_17.out3@L1, other=getItemAtIndex@L2)
code_block_20 = CodeBlock(X=distanceTo)
# ---------- code_block_20.designscript (3 lines) ----------
X>3?
	X:
	0;
# ----------------------------------------
sum = Math.Sum(values=code_block_20@L2)
sum_2 = Math.Sum(values=sum)
proximity_score_minimize = Watch(sum_2)  # graph output

# group: Evaluate for Noise
distanceTo_2 = Geometry.DistanceTo(geometry=code_block_17.out7, other=code_block_17.out7, lacing=CrossProduct)
code_block_21 = CodeBlock { 3; }
le = distanceTo_2 <= code_block_21
filterByBoolMask = List.FilterByBoolMask(list=code_block_17.out6@L2, mask=le@L2, lacing=Longest)
maximumItem = List.MaximumItem(list=filterByBoolMask.in@L2)
sub = maximumItem - code_block_17.out8
sum_3 = Math.Sum(values=sub)
noise_rating = Watch(sum_3)  # graph output

code_block_22 = CodeBlock { 0; }

# group: Write scores next to floor plan
list_create_4 = List.Create(item0=proximity_score_minimize, item1=noise_rating)
round = Math.Round(number=proximity_score_minimize, digits=code_block_22)
string_from_array = FromArray(arr=round)
code_block_23 = CodeBlock(Proximity=string_from_array) { "Proximity Score: " + Proximity; }
number_slider = DoubleSlider(11.204, range=0..100 step 0.1)
number_slider_2 = DoubleSlider(-28.114, range=-29.363..100 step 0.1)
byCoordinates = Point.ByCoordinates(x=number_slider, y=number_slider_2)
code_block_24 = CodeBlock { 2; }
fromStringOriginAndScale_2 = DynamoText.Text.FromStringOriginAndScale(text=code_block_23, origin=byCoordinates, scale=code_block_24)
code_block_25 = CodeBlock(Noise=noise_rating) { "Noise Rating: " + Noise; }
number_slider_3 = DoubleSlider(10.869, range=0..100 step 0.1)
number_slider_4 = DoubleSlider(-25.697, range=-25.697..100 step 0.1)
byCoordinates_2 = Point.ByCoordinates(x=number_slider_3, y=number_slider_4)
code_block_26 = CodeBlock { 2; }
fromStringOriginAndScale_3 = DynamoText.Text.FromStringOriginAndScale(text=code_block_25, origin=byCoordinates_2, scale=code_block_26)
