# Dynamo custom node RFNRY-ADSK-SA-XX-GR-Z-0022 nth permutation.DYF "nth permutation" (Dynamo 2.0.2.6826)
# category: Jacob Small
# Finds the lexicographically ordered permutation at the given index without calculating all permutations in the set.

ListToPermutate = Input(ListToPermutate: var[]..[])  # List in original order.
PermutationList = Input(PermutationList: var[]..[])  # List of billion range permutations
python_script = Python(IN[0]=ListToPermutate, IN[1]=PermutationList)
# ---------- python_script.python (37 lines) ----------
import clr
clr.AddReference('ProtoGeometry')
from Autodesk.DesignScript.Geometry import *
from math import *

def from_rank(rank, lst):
    my_lst = sorted(lst)
    ret = []
    while my_lst:
        fact = factorial(len(my_lst) - 1)
        idx, rank = divmod(rank, fact)
        ret.append(my_lst.pop(idx))
    assert rank == 0  # invalid rank - out of range
    return ret

lista = IN[1]
count = len(lista)
powers = range(0,count)
listb = []

for p in powers:
	listb.append(pow(1000000000,p))

rank = sum([a*b for a,b in zip(lista,listb)])

lst = IN[0]

maxrank = factorial(len(lst))-1

if rank > maxrank:
	adjustrank = maxrank
else:
	adjustrank = rank

perm = from_rank(adjustrank,lst)

OUT = [maxrank, rank, adjustrank, perm]
# ----------------------------------------
code_block = CodeBlock(a=python_script) { a[3]; a[0]; a[1]; a[2]; }
ReorderedList = Output(code_block.out0)
MaxRank = Output(code_block.out1)
RankSent = Output(code_block.out2)
RankUsed = Output(code_block.out3)
