# Dynamo graph RFNRY-ADSK-SA-XX-GR-Z-0023 Stadium.dyn "StadiumOTx" (Dynamo 2.0.2.6826)

# group: Playing Field (Fixed)
code_block = CodeBlock { 68; [105,74]; 9.5; }
byCenterPointRadius = Circle.ByCenterPointRadius(radius=code_block.out2)
byWidthLength = Rectangle.ByWidthLength(width=code_block.out0, length=code_block.out1)
byPatch = Surface.ByPatch(closedCurve=byWidthLength)
color_palette = ColorPalette({R: 127, G: 255, B: 0, A: 255})
byGeometryColor = Modifiers.GeometryColor.ByGeometryColor(geometry=byPatch, color=color_palette)

# group: Interior Edge (fixed)
width = DoubleSlider(41, range=41..100 step 0.1)
length = DoubleSlider(59, range=41..100.991 step 0.1)

# group: Filletted Half Rectangle
code_block_2 = CodeBlock(w=width, l=length) { w*2; l*2; }
byWidthLength_2 = Rectangle.ByWidthLength(width=code_block_2.out0, length=code_block_2.out1)
code_block_3 = CodeBlock { -5; }
fillet = PolyCurve.Fillet(polyCurve=byWidthLength_2, radius=code_block_3)
byCoordinates = Point.ByCoordinates(x=width)
byLengths = Cuboid.ByLengths(origin=byCoordinates, width=code_block_2.out0, length=code_block_2.out1)
intersect = Geometry.Intersect(geometry=fillet, other=byLengths)
byJoinedCurves = PolyCurve.ByJoinedCurves(curves=intersect)

# group: Inputs: Back and Height of Stadium
depth = DoubleSlider(24.9, range=10..40 step 0.1)  # graph input
height = DoubleSlider(35.7, range=20..40 step 0.1)  # graph input

# group: GENERATOR: Create Stepped Bowl Profile
code_block_4 = CodeBlock { 0..25; }
remapRange = Math.RemapRange(numbers=code_block_4, newMax=depth)
add = remapRange + width
code_block_5 = CodeBlock(x=code_block_4) { Math.Pow(x,2); }
remapRange_2 = Math.RemapRange(numbers=code_block_5, newMax=height)
byCoordinates_2 = Point.ByCoordinates(x=add, z=remapRange_2)
byPoints = NurbsCurve.ByPoints(points=byCoordinates_2)
code_block_6 = CodeBlock { RowDepth = 0.9; }
code_block_7 = CodeBlock(depth=code_block_6) { 0..100..depth; }
add_2 = code_block_7 + width
byCoordinates_3 = Point.ByCoordinates(x=add_2)
XAxis = Vector.XAxis()
byOriginNormal = Plane.ByOriginNormal(origin=byCoordinates_3, normal=XAxis)
intersect_2 = Geometry.Intersect(geometry=byPoints, other=byOriginNormal)
restOfItems = List.RestOfItems(list=intersect_2)
code_block_8 = CodeBlock { Vector.ByCoordinates(0,0,-1); 3; }
byStartPointDirectionLength = Line.ByStartPointDirectionLength(startPoint=restOfItems, direction=code_block_8.out0, length=code_block_8.out1)
byOriginNormal_2 = Plane.ByOriginNormal(origin=intersect_2)
intersect_3 = Geometry.Intersect(geometry=byStartPointDirectionLength, other=byOriginNormal_2)
create = List.Create(item0=intersect_2, item1=intersect_3)
transpose = List.Transpose(lists=create)
flatten = List.Flatten(list=transpose)
clean = List.Clean(list=flatten)
byPoints_2 = PolyCurve.ByPoints(points=clean)
bySweep = PolySurface.BySweep(rail=byJoinedCurves, crossSection=byPoints_2)

# group: EVALUATE: How Much Seating area? Maximize
surfaces = PolySurface.Surfaces(polySurface=bySweep)
normalAtParameter = Surface.NormalAtParameter(surface=surfaces)
Z = Vector.Z(vector=normalAtParameter)
abs = Math.Abs(number=Z)
code_block_9 = CodeBlock { 1; }
eq = abs == code_block_9
filterByBoolMask = List.FilterByBoolMask(list=surfaces, mask=eq)
area = Surface.Area(surface=filterByBoolMask.in)
sum = Math.Sum(values=area)

# group: EVALUTE: What is the furthest seat? Minimize
perimeterCurves = Surface.PerimeterCurves(surface=bySweep)
byJoinedCurves_2 = PolyCurve.ByJoinedCurves(curves=perimeterCurves)
code_block_10 = CodeBlock { 0..1..#50; }
pointAtParameter = Curve.PointAtParameter(curve=byJoinedCurves_2, param=code_block_10, lacing=CrossProduct)
origin = Point.Origin()
distanceTo = Geometry.DistanceTo(geometry=pointAtParameter, other=origin)
maximumItem = List.MaximumItem(list=distanceTo)

# group: EVALUATE: View Quality, Maximize
X = Point.X(point=restOfItems)
flatten_2 = List.Flatten(list=X)
Z_2 = Point.Z(point=restOfItems)
code_block_11 = CodeBlock(riser=Z_2) { riser +1; }
flatten_3 = List.Flatten(list=code_block_11)
Z_3 = Point.Z(point=intersect_3)
flatten_4 = List.Flatten(list=Z_3)
# note: The calculation is the "C-Value" - an industry standard way of quantifying view quality
# D = the horizontal distance from the eye to the point of focus
# N = the riser height
# R = the vertical height to the point of focus
# T = the seating row depth
sub = flatten_3 - flatten_4
code_block_12 = CodeBlock(D=flatten_2, N=sub, R=flatten_3, T=code_block_6) { c=(D*(N+R)/(D+T))-R; }
average = Math.Average(numbers=code_block_12)

# group: Outputs
seating_area = Watch(sum)  # graph output
back_row_distance = Watch(maximumItem)  # graph output
viewQuality = Watch(average)  # graph output

# group: Color Seats
color_palette_2 = ColorPalette({R: 169, G: 169, B: 169, A: 255})
byGeometryColor_2 = Modifiers.GeometryColor.ByGeometryColor(geometry=bySweep, color=color_palette_2)
