# Dynamo graph RFNRY-ADSK-SA-XX-GR-Z-0024 OpenOfficeLayout.dyn "OpenOfficeLayout" (Dynamo 2.2.1.5175)

# note: Revit Output
# Blue indicates notes that are used for creating and updating Revit elements.
# note: Outputs / Evaluation
# Orange indicates checking nodes to ensure the script has deployed correctly.
# note: Functions / Calculations
# Green indicates the working of the script.
# note: Variables / Inputs
# Red indicates Variables that can be altered per project and must be set accordingly before running the script.
# note: Revit Gather
# Light Blue indicates notes that are used for getting data from Revit elements.
# note: Dictionary Recording
# Blue-Green indicates the working of the script.
# note: Result Visualizaton
# Purple indicates nodes to allow visual review of the results.

# group: OPEN OFFICE DESK LAYOUT Refinery Graph Example
# note: DESCRIPTION
# This definition generates open office desk layout test fits for use in an open work configuration. When used in combination with Refinery, this definition will help users explore layouts based on the evaluated metrics.
# note: DYNAMO PROJECT
# OpenOfficeLayout.dyn
# note: DYNAMO VERSION
# 2.0.2
# note: ASSOCIATED FILES
# OpenOfficeSpace.rvt
# note: AUTHORS / CREATION DATE
# Jacob Small - March 2019
# @JacobWSmall
# note: REQUIRED DYNAMO PACKAGES
# Refinery, Dynamo for Revit
# note: ADDITIONAL COMMENTS
# Initial Concept via Nate Miller of Proving Ground. https://provingground.io/tools/lunchbox/

# group: Toggles various aspects of the graph.
evaluate_design = BoolSelector(true)
visualize_design = BoolSelector(true)
create_revit_elements = BoolSelector(false)

# group: Select a Revit room, area or space element.
select_model_element = DSModelElementSelection()  # 1 picked in the model

# group: Gathers the solids and remembers them for later use in environments outside of Dynamo for Revit.
solids = Element.Solids(element=select_model_element)
remember = Data.Remember(solids)

code_block = CodeBlock { 0; }
getItemAtIndex = List.GetItemAtIndex(list=remember, index=code_block)

# group: Inputs for the workstation and layout constants.
rotate = IntegerSlider(0, range=-18..18 step 1)  # graph input
postion_on_room_surface_u = IntegerSlider(0, range=0..10 step 1)  # graph input
position_on_room_surface_v = DoubleSlider(0, range=0..1 step 0.001)
desk_width_ft = DoubleSlider(3, range=3..6 step 0.1)
desk_length_ft = DoubleSlider(5, range=4..6 step 0.1)
user_clearance_width_ft = DoubleSlider(2, range=2..6 step 0.1)
user_clearance_length_ft = DoubleSlider(0, range=0..4 step 0.1)
additional_circulation_spacing = DoubleSlider(2, range=0..6 step 0.1)  # "Additional Circulation Spacing (Ft)"
end_offset_ft = DoubleSlider(4, range=4..6 step 0.1)
n3dPreview = BoolSelector(true)  # "3dPreview"

code_block_2 = CodeBlock(x=rotate) { x*5; }
code_block_3 = CodeBlock(x=postion_on_room_surface_u) { x/10; }

# group: Creates a Dictionary from the inputs and remembered data from revit, to facilitate easier data structure.
code_block_4 = CodeBlock()
# ---------- code_block_4.designscript (13 lines) ----------
[
	"RoomGeo",
	"Rotation",
	"StartU",
	"StartV",
	"DeskWidth",
	"DeskLength",
	"UserClearanceWidth",
	"UserClearanceLength",
	"AdditionalCirculation",
	"EndOffset",
	"3DPreview"
];
# ----------------------------------------
list_create = List.Create(item0=getItemAtIndex, item1=code_block_2, item2=code_block_3, item3=position_on_room_surface_v, item4=desk_width_ft, item5=desk_length_ft, item6=user_clearance_width_ft, item7=user_clearance_length_ft, item8=additional_circulation_spacing, item9=end_offset_ft, item10=n3dPreview)
byKeysValues = DesignScript.Builtin.Dictionary.ByKeysValues(keys=code_block_4, values=list_create)

# group: Explodes the room geo to it's core parts
string = StringInput("RoomGeo")
valueAtKey = DesignScript.Builtin.Dictionary.ValueAtKey(dictionary=byKeysValues, key=string)
explode = Geometry.Explode(geometry=valueAtKey)

# group: Gets the middle point for each surface of the room geography, querries the Z value, and sortz the surfaces by this (putting the surface with the lowest midpoint first).
code_block_5 = CodeBlock { 0.5; }
pointAtParameter = Surface.PointAtParameter(surface=explode, u=code_block_5, v=code_block_5)
Z = Point.Z(point=pointAtParameter)
sortByKey = List.SortByKey(list=explode, keys=Z)

# group: Gets the first surface from the list of sorted surfaces. and pulls the perimeter curves.
firstItem = List.FirstItem(list=sortByKey.sorted_list)
perimeterCurves = Surface.PerimeterCurves(surface=firstItem)

# group: Groups the curves using the custom design script definition below and generates a single poly line.
code_block_6 = CodeBlock(x=perimeterCurves) { grpCrvs(x); }
byJoinedCurves = PolyCurve.ByJoinedCurves(curves=code_block_6)

# group: Builds a surface from each polycurve, gets the area, and sorts the polycurves by this value.
byPatch = Surface.ByPatch(closedCurve=byJoinedCurves)
area = Surface.Area(surface=byPatch)
sortByKey_2 = List.SortByKey(list=byJoinedCurves, keys=area)

# group: Gets the end offset distance.
string_2 = StringInput("EndOffset")
valueAtKey_2 = DesignScript.Builtin.Dictionary.ValueAtKey(dictionary=byKeysValues, key=string_2)

# group: Gets the largest area polycurve and offsets it by the inverse of the end offset distance.
lastItem = List.LastItem(list=sortByKey_2.sorted_list)
code_block_7 = CodeBlock(x=valueAtKey_2) { -x; }
offset = Curve.Offset(curve=lastItem, distance=code_block_7)

# group: Splits the floor surface by the offset curve, and gets the innermost resulting surface.
split = Geometry.Split(geometry=firstItem, other=offset)
lastItem_2 = List.LastItem(list=split)

# group: Adds the perimeter curves to the dictionary.
code_block_8 = CodeBlock()
# ---------- code_block_8.designscript (3 lines) ----------
["FloorSurface",
"RoomCurves",
"PopulationArea"];
# ----------------------------------------
list_create_2 = List.Create(item0=firstItem, item1=perimeterCurves, item2=lastItem_2)
setValueAtKeys = DesignScript.Builtin.Dictionary.SetValueAtKeys(dictionary=byKeysValues, keys=code_block_8, values=list_create_2)

# group: Gets the relevant info from the dictionary to build the workstation geometry, and performs some basic arthimetic.
code_block_9 = CodeBlock()
# ---------- code_block_9.designscript (7 lines) ----------
["DeskLength",
"DeskWidth",
"UserClearanceLength",
"UserClearanceWidth",
"Rotation",
"3DPreview"
];
# ----------------------------------------
valueAtKey_3 = DesignScript.Builtin.Dictionary.ValueAtKey(dictionary=setValueAtKeys, key=code_block_9)
code_block_10 = CodeBlock(a=valueAtKey_3)
# ---------- code_block_10.designscript (39 lines) ----------
DeskLength =
	a[0];
DeskWidth =
	a[1];

DeskShift =
	a[1]/2;




DeskHeight =
	a[5] ? 2.5: 1/12;













WorkstationWidth =
	a[0]+a[2];
WorkstationLength =
	a[1]+a[3];
WorkstationShift =
	WorkstationLength/2;





RotationAngle =
	a[4];
# ----------------------------------------

# group: Creates the desk area and moves it into position.
byWidthLength = Rectangle.ByWidthLength(width=code_block_10.DeskLength, length=code_block_10.DeskWidth)
translate = Geometry.Translate(geometry=byWidthLength, yTranslation=code_block_10.DeskShift)

# group: Finds the center of the desk at floor level.
center = Polygon.Center(polygon=translate)

# group: Moves the desk polygon to workstation height and extrudes it.
translate_2 = Geometry.Translate(geometry=translate, zTranslation=code_block_10.DeskHeight)
code_block_11 = CodeBlock { -1.5/12; }

code_block_12 = CodeBlock { -1/12; }
offset_2 = Curve.Offset(curve=translate_2, distance=code_block_12)

# group (continued): Moves the desk polygon to workstation height and extrudes it.
extrudeAsSolid = Curve.ExtrudeAsSolid(curve=offset_2, distance=code_block_11)

# group: Creates the workstation area and moves it to the origin.
byWidthLength_2 = Rectangle.ByWidthLength(width=code_block_10.WorkstationWidth, length=code_block_10.WorkstationLength)
translate_3 = Geometry.Translate(geometry=byWidthLength_2, yTranslation=code_block_10.WorkstationShift)

# group: Makes a surface from the workstation area.
byPatch_2 = Surface.ByPatch(closedCurve=translate_3)

# group: Pulls the workstation geometry into a single list.
list_create_3 = List.Create(item0=center, item1=extrudeAsSolid, item2=translate_3, item3=byPatch_2)

# group: Rotates the workstation geometry 0 and 180 degrees about the Z axis to create a back to back workstation setup.
origin = Point.Origin()
ZAxis = Vector.ZAxis()
code_block_13 = CodeBlock { [90,270]; }
rotate_2 = Geometry.Rotate(geometry=list_create_3@L2, origin=origin, axis=ZAxis, degrees=code_block_13, lacing=CrossProduct)

identity = Object.Identity(obj=code_block_10.RotationAngle)

# group: Rotates the desk to match the angle of the rows.
origin_2 = Point.Origin()
ZAxis_2 = Vector.ZAxis()
rotate_3 = Geometry.Rotate(geometry=rotate_2, origin=origin_2, axis=ZAxis_2, degrees=identity)

# group: Adds the the back to back workstation setup to the dictionary.
code_block_14 = CodeBlock { "WorkstationGrouping"; }
setValueAtKeys_2 = DesignScript.Builtin.Dictionary.SetValueAtKeys(dictionary=setValueAtKeys, keys=code_block_14, values=rotate_3)

# group: Gets the relevant info from the dictionary to build the workstation geometry, and performs some basic arthimetic.
code_block_15 = CodeBlock()
# ---------- code_block_15.designscript (12 lines) ----------
[
	"PopulationArea",
	"StartV",
	"StartU",
	"Rotation",
	"DeskWidth",
	"UserClearanceWidth",
	"AdditionalCirculation",
	"DeskLength",
	"UserClearanceLength",
	"WorkstationGrouping"
];
# ----------------------------------------
valueAtKey_4 = DesignScript.Builtin.Dictionary.ValueAtKey(dictionary=setValueAtKeys_2, key=code_block_15)
code_block_16 = CodeBlock(a=valueAtKey_4)
# ---------- code_block_16.designscript (69 lines) ----------
PopulationArea =
	a[0];

DeskGeom =
	a[9];

PopulationArea;
StartU =
	a[1];
StartV =
	a[2];










RotationAngle =
	a[3];





PopulationArea;


















RowOffset =
	2*(a[4]+a[5]+a[6]/2);















WorkstationLength =
	a[7]+a[8]/2;


RotationAngle;
# ----------------------------------------

# group: Finds the base point to start the layout lines.
pointAtParameter_2 = Surface.PointAtParameter(surface=code_block_16.out2, u=code_block_16.out3, v=code_block_16.out4)

# group: Rotates the Y axis by the rotation angle.
YAxis = Vector.YAxis()
ZAxis_3 = Vector.ZAxis()
rotate_4 = Vector.Rotate(vector=YAxis, axis=ZAxis_3, degrees=code_block_16.out5)

# group: Builds a bounding box aroudn the population area, and gets the distance between the minimum and maximum corner.
boundingBox = Geometry.BoundingBox(geometry=code_block_16.out6)
maxPoint = BoundingBox.MaxPoint(boundingBox=boundingBox)
minPoint = BoundingBox.MinPoint(boundingBox=boundingBox)
distanceTo = Geometry.DistanceTo(geometry=maxPoint, other=minPoint)

# group: Doubles the distance of the maximum line distance.
code_block_17 = CodeBlock { 2; }
mul = code_block_17 * distanceTo

# group: Generates a line from the start point along the rotation vector
byStartPointDirectionLength = Line.ByStartPointDirectionLength(startPoint=pointAtParameter_2, direction=rotate_4, length=mul)

# group: Reverses the rotation vector.
reverse = Vector.Reverse(vector=rotate_4)

# group: Moves the line along the reverse vector by 1/2 of it's length.
translate_4 = Geometry.Translate(geometry=byStartPointDirectionLength, direction=reverse, distance=distanceTo)

# group: Divides the distance by the step value, and adds one.
div = distanceTo / code_block_16.out7
number = DoubleInput(1)
add = div + number

# group: Generates a sequence starting at 0, stepping by the value and stop.ping afte rthe adjusted count
number_2 = DoubleInput(0)
sequence = Sequence(start=number_2, amount=add, step=code_block_16.out7)

# group: Multiplies the sequence by -1 and 1, flattens the resulting lists, and removes any duplicates.
code_block_18 = CodeBlock { [1,-1]; }
mul_2 = code_block_18 * sequence  # lacing=CrossProduct
flatten = List.Flatten(list=mul_2)
uniqueItems = List.UniqueItems(list=flatten)

# group: Offsets the initial curves by the calculated series of offset values, and then gets only the curve geometries which overlap wiht the initial population area and flattens that list.
offset_3 = Curve.Offset(curve=translate_4, distance=uniqueItems)
intersect = Geometry.Intersect(geometry=code_block_16.out2, other=offset_3)
flatten_2 = List.Flatten(list=intersect)

# group: Gets 1/2 of the workstation length
code_block_19 = CodeBlock { 0.5; }
mul_3 = code_block_19 * code_block_16.out8

# group: generates a range from 1/2 of the workstation length to the distance of the bounding box's diagonal, stepping by the range.
# note: Check the lists section of the dynamo primer if these concepts are foriegn.
range = Range(start=mul_3, end=distanceTo, step=code_block_16.out8)

# group: Gets points along the offset curves at the segment lengths generated by the corresponding distances.
identity_2 = Object.Identity(obj=range)
pointAtSegmentLength = Curve.PointAtSegmentLength(curve=flatten_2, segmentLength=identity_2, lacing=CrossProduct)

identity_3 = Object.Identity(obj=code_block_16.out8)

# group: Subtracts 1/12 of a unit (ok an inch) from the width of the workstation.
identity_4 = Object.Identity(obj=identity_3)
code_block_20 = CodeBlock { 1/12; }
sub = identity_4 - code_block_20

# group: Removes any duplicate points from the list, using the workstation length less 1/12 of a unit as a tolerance.
pruneDuplicates = Point.PruneDuplicates(points=pointAtSegmentLength, tolerance=sub)

# group: Creates a vector from the origin to each point, and flattens the list.
origin_3 = Point.Origin()
byTwoPoints = Vector.ByTwoPoints(start=origin_3, end=pruneDuplicates)
flatten_3 = List.Flatten(list=byTwoPoints)

# group: Moves the workstation geometry into position at each point.
translate_5 = Geometry.Translate(geometry=code_block_16.out1, direction=flatten_3, lacing=CrossProduct)

identity_5 = Object.Identity(obj=code_block_16.out9)

# group: Transposes the list, counts the number of sublists, and duplicates the rotation angle and 180+ the rotation angle that many times before adding the resulting values into the list, and transposing the sublists back to the original format.
transpose = List.Transpose(lists=translate_5)
code_block_21 = CodeBlock(a=identity_5) { a+[0,180]; }
count = List.Count(list=transpose)
ofRepeatedItem = List.OfRepeatedItem(item=code_block_21, amount=count)
code_block_22 = CodeBlock { 4; }
insert = List.Insert(list=transpose@@L2, element=ofRepeatedItem@L1, index=code_block_22)
transpose_2 = List.Transpose(lists=insert)

# group: Gets the surface representing the extents of each workstation, and intersects that with the surface that represents the populatable area, and flattens the result.
lastItem_3 = List.LastItem(list=translate_5@@L2, lacing=Longest)
intersect_2 = Geometry.Intersect(geometry=code_block_16.out0, other=lastItem_3)
flatten_4 = List.Flatten(list=intersect_2@L3)

# group: Compares the area of the intersecting surface area with the original surface area, to serve as a mask.
area_2 = Surface.Area(surface=flatten_4)
area_3 = Surface.Area(surface=lastItem_3)
eq = area_2 == area_3

# group: Filters the sublists by the surface comparison mask, and transposes the combination list into it's various parts.
filterByBoolMask = List.FilterByBoolMask(list=transpose_2@L3, mask=eq@L2)
flatten_5 = List.Flatten(list=filterByBoolMask.in@L2)
transpose_3 = List.Transpose(lists=flatten_5)

# group: Adds the various parts to the dictionary. Generation is now done.
code_block_23 = CodeBlock()
# ---------- code_block_23.designscript (7 lines) ----------
[
	"DeskLocations",
	"DeskGeomPreview",
	"WorkstationBounds",
	"WorkstationAreas",
	"DeskAngle"
];
# ----------------------------------------
setValueAtKeys_3 = DesignScript.Builtin.Dictionary.SetValueAtKeys(dictionary=setValueAtKeys_2, keys=code_block_23, values=transpose_3)

# group: Serves as a gate to pass either the dictionary, or a null value.
code_block_24 = CodeBlock(run=evaluate_design, a=setValueAtKeys_3)
# ---------- code_block_24.designscript (3 lines) ----------
run?
	a:
	null;
# ----------------------------------------

# group: Gets the relevant values from the dictionary, and organizes the contents acordingly for evaluation.
code_block_25 = CodeBlock()
# ---------- code_block_25.designscript (6 lines) ----------
[
	"DeskGeomPreview",
	"WorkstationGrouping",
	"FloorSurface",
	"DeskLocations"
];
# ----------------------------------------
valueAtKey_5 = DesignScript.Builtin.Dictionary.ValueAtKey(dictionary=code_block_24, key=code_block_25)
code_block_26 = CodeBlock(a=valueAtKey_5)
# ---------- code_block_26.designscript (15 lines) ----------
Workstations =
	a[0];

WorkstationGrouping =
	a[1][0][3];

FloorSurface =
	a[2];





DeskLocations =
	a[3];
# ----------------------------------------

# group: Evaluate Design
clean = List.Clean(list=code_block_26.Workstations)
count_2 = List.Count(list=clean)
desk_count = Watch(count_2)  # graph output
area_4 = Surface.Area(surface=code_block_26.FloorSurface)
div_2 = area_4 / count_2
area_per_desk = Watch(div_2)  # graph output
area_5 = Surface.Area(surface=code_block_26.WorkstationGrouping)
div_3 = area_5 / div_2
utilization = Watch(div_3)  # graph output
distanceTo_2 = Geometry.DistanceTo(geometry=code_block_26.DeskLocations, other=code_block_26.DeskLocations, lacing=CrossProduct)
code_block_27 = CodeBlock(a=distanceTo_2)
# ---------- code_block_27.designscript (2 lines) ----------
DeskScore =
	Math.Sum(a < 12? 1 : 0);
# ----------------------------------------
code_block_28 = CodeBlock(a=code_block_27) { Math.Sum(a < 5 ? 1 : 0); }
number_of_private_desks = Watch(code_block_28)  # graph output

# group: Serves as a gate to pass either the dictionary, or a null value.
code_block_29 = CodeBlock(run=visualize_design, a=setValueAtKeys_3)  # same code as code_block_24

# group: Gets the relevant values from the dictionary, and organizes the contents acordingly for display.
code_block_30 = CodeBlock()
# ---------- code_block_30.designscript (8 lines) ----------
[
	"DeskGeomPreview",
	"WorkstationBounds",
	"RoomGeo",
	"RoomCurves",
	"FloorSurface",
	"3DPreview"
];
# ----------------------------------------
valueAtKey_6 = DesignScript.Builtin.Dictionary.ValueAtKey(dictionary=code_block_29, key=code_block_30)
code_block_31 = CodeBlock(a=valueAtKey_6)
# ---------- code_block_31.designscript (32 lines) ----------
Desks =
	a[0];

Color.ByARGB(255,0,0,255);



WorkstationBounds =
	a[1];

Color.ByARGB(255,0,255,255);



RoomGeo =
	a[5] ? a[2] : null;

Color.ByARGB(80,200,200,200);



RoomCurves =
	a[3];

Color.ByARGB(255,0,255,0);



FloorSurf =
	a[4];

Color.ByARGB(255,128,128,128);
# ----------------------------------------

# group: Displays the appropriate generated design to provide more immediate understanding of results.
byGeometryColor = Modifiers.GeometryColor.ByGeometryColor(geometry=code_block_31.Desks, color=code_block_31.out1)
byGeometryColor_2 = Modifiers.GeometryColor.ByGeometryColor(geometry=code_block_31.WorkstationBounds, color=code_block_31.out3)
byGeometryColor_3 = Modifiers.GeometryColor.ByGeometryColor(geometry=code_block_31.RoomGeo, color=code_block_31.out5)
byGeometryColor_4 = Modifiers.GeometryColor.ByGeometryColor(geometry=code_block_31.RoomCurves, color=code_block_31.out7)
byGeometryColor_5 = Modifiers.GeometryColor.ByGeometryColor(color=code_block_31.out9)  # unwired: geometry

# group: Custom Design Script Definitions
code_block_32 = CodeBlock()
# ---------- code_block_32.designscript (35 lines) ----------
/*Custom design script written by Vikram Subbaiah,
http://www.testingwaters.net/
https://forum.dynamobim.com/t/grouping-of-curves-with-design-script/15122/2
*/

def grpCrvs(crv:var[]..[])
    {
    	dis1 = (crv.StartPoint)<1>.DistanceTo(crv<2>)==0
        ||(crv.EndPoint)<1>.DistanceTo(crv<2>)==0;
    	ind1 = DSCore.List.AllIndicesOf(dis1<1>,true);
    	bln1 = true;
    	ind2 = [Imperative]
    	{
    		while (bln1)
    		{
    			cnt1 = DSCore.List.Count(ind1);
    			ind1 = grpIndx(ind1);
    			cnt2 = DSCore.List.Count(ind1);
    			bln1 = cnt2!=cnt1;
    		}
    		return = ind1;
    	}
    	crv1 = DSCore.List.GetItemAtIndex(crv,ind2);
    	return = crv1;
    };

    def grpIndx(ind:var[]..[])
    {
    	ind1 = DSCore.List.SetIntersection(ind<1>,ind<2>);
    	cnt1 = DSCore.List.Count(ind1<1><2>)>0;
    	ind2 = DSCore.List.FilterByBoolMask(ind,cnt1<1>)["in"];
    	ind3 = DSCore.List.UniqueItems(DSCore.List.Flatten(ind2<1>,-1)<1>);
    	ind4 = DSCore.List.UniqueItems(DSCore.List.Sort(ind3<1>));
    	return = ind4;
    };
# ----------------------------------------

# group: Serves as a gate to pass either the dictionary, or a null value.
code_block_33 = CodeBlock(run=create_revit_elements, a=setValueAtKeys_3)  # same code as code_block_24

# group: Gets the relevant values from the dictionary, and organizes the contents acordingly for evaluation.
code_block_34 = CodeBlock()
# ---------- code_block_34.designscript (6 lines) ----------
[
	"DeskLocations",
	"DeskAngle",
	"DeskWidth",
	"DeskLength"
];
# ----------------------------------------
valueAtKey_7 = DesignScript.Builtin.Dictionary.ValueAtKey(dictionary=code_block_33, key=code_block_34)
code_block_35 = CodeBlock(a=valueAtKey_7)
# ---------- code_block_35.designscript (11 lines) ----------
DeskLocations =
	a[0];

DeskAngles =
	90-a[1];

DeskLength =
	a[3];

DeskWidth =
	a[2];
# ----------------------------------------

# group: Creates family instances at the location of each desk generated.
family_types = FamilyTypes("BasicWorkDesk:BasicWorkDesk")
byPoint = FamilyInstance.ByPoint(familyType=family_types, point=code_block_35.DeskLocations)

# group: Sets the rotation of each family instance.
setRotation = FamilyInstance.SetRotation(familyInstance=byPoint, degree=code_block_35.DeskAngles)

# group: Sets the length of each family instance.
string_3 = StringInput("Length")
setParameterByName = Element.SetParameterByName(element=setRotation, parameterName=string_3, value=code_block_35.DeskLength)

# group: Sets the width of each family instance.
string_4 = StringInput("Width")
setParameterByName_2 = Element.SetParameterByName(element=setParameterByName, parameterName=string_4, value=code_block_35.DeskWidth)
